# Grasshopper definition Cheat-Sheet-BHoM-Loading.gh (Grasshopper 1.0.7)
# plug-ins: BH.UI.Grasshopper

# ---- group: Push
# Cheat-Sheet-BHoM-Loading
# LEGEND
# PointLoads
# It is necessary to use two staged push in practice.
# 
# - Stage1:  Push the geometry into RFEM6
# 
# - Stage2: Push Loads into RFEM6
# 
# Befor pushing the loads of this documentplease push the
# Geometry attached to the adapter Below.
# Free LineLoad
# Non - Free LineLoad
# Bar Load + Push
# AreaLoad
toggle = BooleanToggle(False)
# Loads usually require between three andfour inputs
# 1. Location: Where Loads attacks *
# 2. Objects: What Objects Is Affected*
# 3. Force Vector(s)
# 4. LoadCase
# *For PointLoads, Non-Free Lineloads, BarForces and AreaLoads Location and Objects are the same.
bhom = BHoMObject(
    [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],
    ObjectType="{ \"_t\" : \"System.Type\", \"Name\" : \"System.Object, mscorlib, Version=4.0.0.0, Culture=neutral, PublicKeyToken=b77a5c561934e089\", \"_bhomVersion\" : \"7.3\" }",
    m_ForcePreview=False,
    m_MaxItemsPreview=10000)
# Important!!!!
rfem6adapter = RFEM6Adapter(Active=toggle, Component="{ ..ctor")
push = Push(
    Adapter=rfem6adapter,
    Objects=flatten(bhom),
    PushType="{ \"_t\" : \"System.Enum\", \"TypeName\" : { \"_t\" : \"System.Type\", \"Name\" : \"BH.oM.Adapter.PushType\", \"_bhomVersion\" : \"7.3\" }, \"Value\" : \"AdapterDefault\", \"_bhomVersion\" : \"7.3\" }",
    Active=toggle,
    Component="{ .Push")  # -> Objects, Success

# ---- group: Random Points
cluster = Cluster_3()

# ---- group: Loadcase Definition
# PointLoads
loadnature = LoadNature(
    {"Dead": 0, "SuperDead": 1, "Live": 2, "Wind": 3, "Seismic": 4, "Temperature": 5, "Snow": 6, "Accidental": 7, "Prestress": 8, "Notional": 9, "Other": 10}, selected="Dead",
    Component="BH.oM.Structure.Loads.LoadNature",
    Selection=0)
loadcase = Loadcase(Nature=loadnature, Number=Slider(1, range=0..1), Component="BH.oM.Structure.Loads.Loadcase")

# ---- group: Definition of Nodes to apply Loads to
node = Node(Coordinates=cluster, Component="{ .Node")
createtype = CreateType(Component="BH.oM.Structure.Elements.Node")
bhomgroup = BHoMGroup(Elements=node, Type=createtype, Component="{ .BHoMGroup")

# ---- group: Loading Vector Definition
list = ValueList({"X-Vec": 0, "Y-Vec": 1, "Z-Vec": 2, "X-Vec_Rev": 3, "Y-Vec_Rev": 4, "Z-Vec_Rev": 5}, selected="Z-Vec_Rev")
cluster_2 = Cluster(num=list)
vec = Vector(cluster_2)

# ---- group: PointLoad Definition
loadaxis = LoadAxis({"Global": 0, "Local": 1}, selected="Global", Component="BH.oM.Structure.Loads.LoadAxis", Selection=0)
pointload = PointLoad(Loadcase=loadcase, Group=bhomgroup, Force=vec, Axis=loadaxis, Component="{ .PointLoad")

# ---- group: Push
toggle_2 = BooleanToggle(False)
rfem6adapter_2 = RFEM6Adapter(Active=toggle_2, Component="{ ..ctor")
push_2 = Push(
    Adapter=rfem6adapter_2,
    Objects=flatten(pointload),
    PushType="{ \"_t\" : \"System.Enum\", \"TypeName\" : { \"_t\" : \"System.Type\", \"Name\" : \"BH.oM.Adapter.PushType\", \"_bhomVersion\" : \"7.3\" }, \"Value\" : \"AdapterDefault\", \"_bhomVersion\" : \"7.3\" }",
    Active=toggle_2,
    Component="{ .Push")  # -> Objects, Success

# ---- group: Rando panel
select_surface = SelectSurface(i=Slider(0, range=0..1))

# ---- group: LoadCase Definition
# Free LineLoad
loadnature_2 = LoadNature(
    {"Dead": 0, "SuperDead": 1, "Live": 2, "Wind": 3, "Seismic": 4, "Temperature": 5, "Snow": 6, "Accidental": 7, "Prestress": 8, "Notional": 9, "Other": 10}, selected="Wind",
    Component="BH.oM.Structure.Loads.LoadNature",
    Selection=3)
loadcase_2 = Loadcase(Nature=loadnature_2, Number=Slider(6, range=0..10), Component="BH.oM.Structure.Loads.Loadcase")

# ---- group: Loading Vector Definition
list_2 = ValueList({"X-Vec": 0, "Y-Vec": 1, "Z-Vec": 2, "X-Vec_Rev": 3, "Y-Vec_Rev": 4, "Z-Vec_Rev": 5}, selected="Z-Vec_Rev")
cluster_3 = Cluster(num=list_2)
vec_2 = Vector(cluster_3)
rev = Reverse(Vector=vec_2)

# ---- group: Definition of Panel Objects
createtype_2 = CreateType(Component="BH.oM.Structure.Elements.IAreaElement")
bhomgroup_2 = BHoMGroup(Elements=flatten(select_surface), Type=createtype_2, Component="{ .BHoMGroup")

# ---- group: Load Location
crv = Curve(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)

# ----
loadaxis_2 = LoadAxis({"Global": 0, "Local": 1}, selected="Global", Component="BH.oM.Structure.Loads.LoadAxis", Selection=0)
geometricallineload = GeometricalLineLoad(
    Loadcase=loadcase_2,
    Axis=loadaxis_2,
    Projected=Toggle(False),
    ForceA=vec_2,
    ForceB=rev,
    MomentA="{ \"_t\" : \"BH.oM.Geometry.Vector\", \"X\" : 0.0, \"Y\" : 0.0, \"Z\" : 0.0, \"_bhomVersion\" : \"7.3\" }",
    MomentB="{ \"_t\" : \"BH.oM.Geometry.Vector\", \"X\" : 0.0, \"Y\" : 0.0, \"Z\" : 0.0, \"_bhomVersion\" : \"7.3\" }",
    Location=crv,
    Objects=bhomgroup_2,
    Component="BH.oM.Structure.Loads.GeometricalLineLoad")

# ---- group: Push
toggle_3 = BooleanToggle(False)
rfem6adapter_3 = RFEM6Adapter(Active=toggle_3, Component="{ ..ctor")
push_3 = Push(
    Adapter=rfem6adapter_3,
    Objects=flatten(geometricallineload),
    PushType="{ \"_t\" : \"System.Enum\", \"TypeName\" : { \"_t\" : \"System.Type\", \"Name\" : \"BH.oM.Adapter.PushType\", \"_bhomVersion\" : \"7.3\" }, \"Value\" : \"AdapterDefault\", \"_bhomVersion\" : \"7.3\" }",
    Active=toggle_3,
    Component="{ .Push")  # -> Objects, Success

# ---- group: Load Vector Direction
# Non - Free LineLoad
# Comment on Non-Free LineLoads
# The locations input needs to be a line of a panel in the existing RFEM6 model.
list_3 = ValueList({"X-Vec": 0, "Y-Vec": 1, "Z-Vec": 2, "X-Vec_Rev": 3, "Y-Vec_Rev": 4, "Z-Vec_Rev": 5}, selected="Z-Vec_Rev")
cluster_4 = Cluster(num=list_3)
vec_3 = Vector(cluster_4)

# ---- group: Load Case Definition
loadnature_3 = LoadNature(
    {"Dead": 0, "SuperDead": 1, "Live": 2, "Wind": 3, "Seismic": 4, "Temperature": 5, "Snow": 6, "Accidental": 7, "Prestress": 8, "Notional": 9, "Other": 10}, selected="Wind",
    Component="BH.oM.Structure.Loads.LoadNature",
    Selection=3)
loadcase_3 = Loadcase(Nature=loadnature_3, Number=Slider(6, range=0..10), Component="BH.oM.Structure.Loads.Loadcase")

# ---- group: Load Vector Direction
list_4 = ValueList({"X-Vec": 0, "Y-Vec": 1, "Z-Vec": 2, "X-Vec_Rev": 3, "Y-Vec_Rev": 4, "Z-Vec_Rev": 5}, selected="X-Vec")
cluster_5 = Cluster_4(direction=list_4)  # -> relay, V

# ---- group: Location
cluster_6 = Cluster_2()  # -> A, B

# ---- group: Definition Of Non-Free LineLoad
geometricallineload_2 = GeometricalLineLoad(Location=cluster_6.A, Loadcase=loadcase_3, Force=vec_3, Component="{ .GeometricalLineLoad")
loadaxis_3 = LoadAxis({"Global": 0, "Local": 1}, selected="Global", Component="BH.oM.Structure.Loads.LoadAxis", Selection=0)
setproperty = SetProperty(Obj=geometricallineload_2, PropName="Axis", Value=loadaxis_3, Component="{ .SetPropertyValue")
geometricallineloadtypesenum = GeometricalLineLoadTypesEnum(
    {"FreeLineLoad": 0, "NonFreeLineLoad": 1}, selected="NonFreeLineLoad",
    Component="BH.oM.Adapters.RFEM6.Fragments.Enums.GeometricalLineLoadTypesEnum",
    Selection=1)
rfem6geometricallineloadtypes = RFEM6GeometricalLineLoadTypes(
    GeometrialLineLoadType=geometricallineloadtypesenum,
    Component="BH.oM.Adapters.RFEM6.BHoMDataStructure.SupportDatastrures.RFEM6GeometricalLineLoadTypes")
addfragment = AddFragment(IBHoMObject=flatten(setproperty), Fragment=rfem6geometricallineloadtypes, Replace=False, Component="{ .AddFragment")

# ---- group: Definition Of Non-Free LineLoad - Moment
loadaxis_4 = LoadAxis({"Global": 0, "Local": 1}, selected="Global", Component="BH.oM.Structure.Loads.LoadAxis", Selection=0)
geometricallineload_3 = GeometricalLineLoad(
    Loadcase=loadcase_3,
    Axis=loadaxis_4,
    Projected=Toggle(True),
    ForceA="{ \"_t\" : \"BH.oM.Geometry.Vector\", \"X\" : 0.0, \"Y\" : 0.0, \"Z\" : 0.0, \"_bhomVersion\" : \"7.3\" }",
    ForceB="{ \"_t\" : \"BH.oM.Geometry.Vector\", \"X\" : 0.0, \"Y\" : 0.0, \"Z\" : 0.0, \"_bhomVersion\" : \"7.3\" }",
    MomentA=cluster_5.relay,
    MomentB=cluster_5.V,
    Location=cluster_6.B,
    Objects="{ \"_t\" : \"BH.oM.Base.BHoMGroup`1[[BH.oM.Structure.Elements.IAreaElement, Structure_oM, Version=7.0.0.0, Culture=neutral, PublicKeyToken=null]]\", \"Elements\" : [], \"BHoM_Guid\" : \"8408896e-2d24-405e-b3fc-15b7d8c52efa\", \"_bhomVersion\" : \"7.3\" }",
    Component="BH.oM.Structure.Loads.GeometricalLineLoad")
geometricallineloadtypesenum_2 = GeometricalLineLoadTypesEnum(
    {"FreeLineLoad": 0, "NonFreeLineLoad": 1}, selected="NonFreeLineLoad",
    Component="BH.oM.Adapters.RFEM6.Fragments.Enums.GeometricalLineLoadTypesEnum",
    Selection=1)
rfem6geometricallineloadtypes_2 = RFEM6GeometricalLineLoadTypes(
    GeometrialLineLoadType=geometricallineloadtypesenum_2,
    Component="BH.oM.Adapters.RFEM6.BHoMDataStructure.SupportDatastrures.RFEM6GeometricalLineLoadTypes")
addfragment_2 = AddFragment(
    IBHoMObject=flatten(geometricallineload_3),
    Fragment=rfem6geometricallineloadtypes_2,
    Replace=False,
    Component="{ .AddFragment")

# ---- group: Push
toggle_4 = BooleanToggle(False)
merge = Merge(Data2=addfragment, Data3=addfragment_2)
rfem6adapter_4 = RFEM6Adapter(Active=toggle_4, Component="{ ..ctor")
push_4 = Push(
    Adapter=rfem6adapter_4,
    Objects=flatten(merge),
    PushType="{ \"_t\" : \"System.Enum\", \"TypeName\" : { \"_t\" : \"System.Type\", \"Name\" : \"BH.oM.Adapter.PushType\", \"_bhomVersion\" : \"7.3\" }, \"Value\" : \"AdapterDefault\", \"_bhomVersion\" : \"7.3\" }",
    Active=toggle_4,
    Component="{ .Push")  # -> Objects, Success

# ----
# BarUniformlyDistributedLoad + Push
list_5 = ValueList({"X-Vec": 0, "Y-Vec": 1, "Z-Vec": 2, "X-Vec_Rev": 3, "Y-Vec_Rev": 4, "Z-Vec_Rev": 5}, selected="Z-Vec_Rev")
cluster_7 = Cluster(num=list_5)
vec_4 = Vector(cluster_7)

loadnature_4 = LoadNature(
    {"Dead": 0, "SuperDead": 1, "Live": 2, "Wind": 3, "Seismic": 4, "Temperature": 5, "Snow": 6, "Accidental": 7, "Prestress": 8, "Notional": 9, "Other": 10}, selected="Dead",
    Component="BH.oM.Structure.Loads.LoadNature",
    Selection=0)
loadcase_4 = Loadcase(Nature=loadnature_4, Number=Slider(3, range=0..10), Component="BH.oM.Structure.Loads.Loadcase")

bhom_2 = BHoMObject(
    "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",
    ObjectType="{ \"_t\" : \"System.Type\", \"Name\" : \"System.Object, mscorlib, Version=4.0.0.0, Culture=neutral, PublicKeyToken=b77a5c561934e089\", \"_bhomVersion\" : \"7.3\" }",
    m_ForcePreview=False,
    m_MaxItemsPreview=10000)
createtype_3 = CreateType(Component="BH.oM.Structure.Elements.Bar")
bhomgroup_3 = BHoMGroup(Elements=bhom_2, Type=createtype_3, Component="{ .BHoMGroup")

loadaxis_5 = LoadAxis({"Global": 0, "Local": 1}, selected="Global", Component="BH.oM.Structure.Loads.LoadAxis", Selection=0)
baruniformlydistributedload = BarUniformlyDistributedLoad(
    Force=vec_4,
    Moment="{ \"_t\" : \"BH.oM.Geometry.Vector\", \"X\" : 0.0, \"Y\" : 0.0, \"Z\" : 0.0, \"_bhomVersion\" : \"7.3\" }",
    Loadcase=loadcase_4,
    Objects=bhomgroup_3,
    Axis=loadaxis_5,
    Projected=Toggle(True),
    Component="BH.oM.Structure.Loads.BarUniformlyDistributedLoad")

# ---- group: Push
toggle_5 = BooleanToggle(False)
rfem6adapter_5 = RFEM6Adapter(Active=toggle_5, Component="{ ..ctor")
push_5 = Push(
    Adapter=rfem6adapter_5,
    Objects=flatten(baruniformlydistributedload),
    PushType="{ \"_t\" : \"System.Enum\", \"TypeName\" : { \"_t\" : \"System.Type\", \"Name\" : \"BH.oM.Adapter.PushType\", \"_bhomVersion\" : \"7.3\" }, \"Value\" : \"AdapterDefault\", \"_bhomVersion\" : \"7.3\" }",
    Active=toggle_5,
    Component="{ .Push")  # -> Objects, Success

# ----
loadnature_5 = LoadNature(
    {"Dead": 0, "SuperDead": 1, "Live": 2, "Wind": 3, "Seismic": 4, "Temperature": 5, "Snow": 6, "Accidental": 7, "Prestress": 8, "Notional": 9, "Other": 10}, selected="SuperDead",
    Component="BH.oM.Structure.Loads.LoadNature",
    Selection=1)
# AreaUniformlyDistributedLoad
panel = Panel("Random Name")
loadcase_5 = Loadcase(Name=panel, Nature=loadnature_5, Number=Slider(12, range=0..100), Component="BH.oM.Structure.Loads.Loadcase")

list_6 = ValueList({"X-Vec": 0, "Y-Vec": 1, "Z-Vec": 2, "X-Vec_Rev": 3, "Y-Vec_Rev": 4, "Z-Vec_Rev": 5}, selected="Y-Vec_Rev")
cluster_8 = Cluster(num=list_6)
vec_5 = Vector(cluster_8)

bhom_3 = BHoMObject(
    [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],
    ObjectType="{ \"_t\" : \"System.Type\", \"Name\" : \"System.Object, mscorlib, Version=4.0.0.0, Culture=neutral, PublicKeyToken=b77a5c561934e089\", \"_bhomVersion\" : \"7.3\" }",
    m_ForcePreview=False,
    m_MaxItemsPreview=10000)

loadaxis_6 = LoadAxis({"Global": 0, "Local": 1}, selected="Global", Component="BH.oM.Structure.Loads.LoadAxis", Selection=0)
areauniformlydistributedload = AreaUniformlyDistributedLoad(
    Loadcase=loadcase_5,
    Pressure=vec_5,
    Objects=bhom_3,
    Axis=loadaxis_6,
    Projected=False,
    Component="{ .AreaUniformlyDistributedLoad")

# ---- group: Push
toggle_6 = BooleanToggle(False)
rfem6adapter_6 = RFEM6Adapter(Active=toggle_6, Component="{ ..ctor")
push_6 = Push(
    Adapter=rfem6adapter_6,
    Objects=flatten(areauniformlydistributedload),
    PushType="{ \"_t\" : \"System.Enum\", \"TypeName\" : { \"_t\" : \"System.Type\", \"Name\" : \"BH.oM.Adapter.PushType\", \"_bhomVersion\" : \"7.3\" }, \"Value\" : \"AdapterDefault\", \"_bhomVersion\" : \"7.3\" }",
    Active=toggle_6,
    Component="{ .Push")  # -> Objects, Success

# ==== cluster Cluster
number_slider = Slider(100, range=0..100)
num = ClusterInput()
X = UnitX(Factor=number_slider)
num_2 = Number(num)
Y = UnitY(Factor=number_slider)
Z = UnitZ(Factor=number_slider)
rev = Reverse(Vector=X)
rev_2 = Reverse(Vector=Y)
rev_3 = Reverse(Vector=Z)
merge = Merge(Data1=X, Data2=Y, Data3=Z, Data4=rev, Data5=rev_2, Data6=rev_3)
item = ListItem(List=merge, Index=num_2, Wrap=True)
vec = Vector(item)
vec_2 = ClusterOutput(vec)

# ==== cluster SelectSurface
i = ClusterInput()

bhom = BHoMObject(
    [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],
    ObjectType="{ \"_t\" : \"System.Type\", \"Name\" : \"System.Object, mscorlib, Version=4.0.0.0, Culture=neutral, PublicKeyToken=b77a5c561934e089\", \"_bhomVersion\" : \"7.3\" }",
    m_ForcePreview=False,
    m_MaxItemsPreview=10000)
item = ListItem(List=bhom, Index=i, Wrap=True)

i_2 = ClusterOutput(item)

# ==== cluster Cluster_2
bhom = BHoMObject(
    [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],
    ObjectType="{ \"_t\" : \"System.Type\", \"Name\" : \"System.Object, mscorlib, Version=4.0.0.0, Culture=neutral, PublicKeyToken=b77a5c561934e089\", \"_bhomVersion\" : \"7.3\" }",
    m_ForcePreview=False,
    m_MaxItemsPreview=10000)
item = ListItem(List=bhom, Index="1", Wrap=True)
explode = Explode(Curve=item, Recursive=True)  # -> Segments, Vertices
lng = ListLength(List=explode.Segments)
division = Division(A=lng, B="2")
split = SplitList(List=explode.Segments, Index=division)  # -> ListA, ListB
A = ClusterOutput(split.ListA)
B = ClusterOutput(split.ListB)

# ==== cluster Cluster_3

# ---- group: Generating Random Nodes on Geometry
srf = Surface(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)
popgeo = PopulateGeometry(Geometry=srf, Count=Slider(5, range=0..10), Seed=1)
pt = Point(popgeo)

# ----
pt_2 = ClusterOutput(pt)

# ==== cluster Cluster_4
direction = ClusterInput()
cluster = Cluster(num=direction)
vec = Vector(cluster)
relay = ClusterOutput(vec)
rev = Reverse(Vector=vec)
V = ClusterOutput(rev)
