# Grasshopper definition Cheat-Sheet-GH.gh (Grasshopper 1.0.7)
# plug-ins: BH.UI.Grasshopper

getinfo = GetInfo(Component="{ .GetInfo")
# <Script name>
# LEGEND
# Definition of Circles
project_number = Panel("")
setprojectid = SetProjectID(ProjectID=project_number, Component="{ .SetProjectID")
# Divide Curves
# Move Geometry
bhom_version_used_to_create = Panel("7.2")
# Shift Lists
# Create Lines
# Create Surfaces
# Rotate Geometry
bhom_version_currently_installed = Panel(getinfo)

# ----
# Create Circle
panel = Panel("0")
pt = ConstructPoint(XCoordinate=panel, YCoordinate="0", ZCoordinate="0")
cir = Circle(Plane=pt, Radius=Slider(2.52, range=0..10))

# ----
# Divide Curves
curve_segments = Slider(5, range=0..10)
crv = Curve(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)
divide = DivideCurve(Curve=crv, Count=curve_segments, Kinks=False)  # -> Points, Tangents, Parameters

# ----
# Move  Geometry
move_geometry_x_units = Slider(1.8, range=0..10)
crv_2 = Curve(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)
Z = UnitZ(Factor=move_geometry_x_units)
move = Move(Geometry=crv_2, Motion=Z)  # -> Geometry, Transform

# ----
# Shift Lists - Counter Clockwise
rotation_shift_list_by_x_steps = Slider(0, range=0..10)
neg = Negative(Value=rotation_shift_list_by_x_steps)
pt_2 = Point([Point(22.52, 0, 0), Point(20.77872273, 2.396662451, 0), Point(17.96127717, 1.481218827, 0), Point(17.96127718, -1.481218839, 0), Point(20.77872281, -2.396662427, 0)])
shift = ShiftList(List=pt_2, Shift=neg, Wrap=True)
points = PointList(Points=shift, Size=Slider(1, range=0..1))

# ----
# Shift Lists - Clockwise
number_slider = Slider(0, range=0..10)
pt_3 = Point([Point(12.52, 0, 0), Point(10.77872273, 2.396662451, 0), Point(7.961277168, 1.481218827, 0), Point(7.961277177, -1.481218839, 0), Point(10.77872281, -2.396662427, 0)])
rotation_shift_list_by_x_steps_2 = Slider(1, range=0..1)
shift_2 = ShiftList(List=pt_3, Shift=number_slider, Wrap=True)
points_2 = PointList(Points=shift_2, Size=rotation_shift_list_by_x_steps_2)

# ----
# Multiple Lines
pt_4 = Point([Point(-25, -5, 0), Point(-25, -4, 0), Point(-25, -3, 0), Point(-25, -2, 0), Point(-25, -1, 0)])
pt_5 = Point([Point(-15, -5, 0), Point(-15, -4, 0), Point(-15, -3, 0), Point(-15, -2, 0), Point(-15, -1, 0)])
panel_2 = Panel(pt_5)
panel_3 = Panel(pt_4)
ln = Line(StartPoint=pt_4, EndPoint=pt_5)

# ----
# Single Line
pt_6 = Point(Point(-5, 10, 0))
pt_7 = Point(Point(5, 10, 0))
ln_2 = Line(StartPoint=pt_6, EndPoint=pt_7)

# ----
# Surface Surface From Sorted Points
toggle = BooleanToggle(True)
pt_8 = Point([Point(32.52, 0, 0), Point(30.77872273, 2.396662451, 0), Point(27.96127717, 1.481218827, 0), Point(27.96127718, -1.481218839, 0), Point(30.77872281, -2.396662427, 0)])
panel_4 = Panel(pt_8)
pline = PolyLine(Vertices=pt_8, Closed=toggle)
srf = Surface(pline)

# ----
# Surface from Sorted List Of Lines
crv_3 = Curve([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])
panel_5 = Panel(crv_3)
join = JoinCurves(Curves=crv_3, Preserve=False)
srf_2 = Surface(join)

# ----
# Surface From Closed Polyline
crv_4 = Curve(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)
panel_6 = Panel(crv_4)
srf_3 = Surface(crv_4)

# ----
# Rotation of Surface around Z-Axis
number_slider_2 = Slider(90, range=0..360)
srf_4 = Surface(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)
area = Area(Geometry=srf_4)  # -> Area, Centroid
Z_2 = UnitZ(Factor=1)
rad = Radians(Degrees=number_slider_2)
line = LineSDL(Start=area.Centroid, Direction=Z_2, Length=1)
rotax = RotateAxis(Geometry=srf_4, Angle=rad, Axis=line)  # -> Geometry, Transform
