# Grasshopper definition RFEM6_Toolkit_Hack_Session_Full_Script.gh (Grasshopper 1.0.7)
# plug-ins: BH.UI.Grasshopper

getinfo = GetInfo(Component="{ .GetInfo")

# ----
# Plugin Libraries Used: BH.UI.Grasshopper | ver: 7.0.0.0
project_name = Panel("...")
project_number = Panel("...")
author = Panel("HvL")
units = Panel("standard - SI")
associated_rhino_file = Panel("none")
bhom_version_used_to_create = Panel("7.1")
bhom_version_currently_installed = Panel(getinfo)
setprojectid = SetProjectID(ProjectID=project_number, Component="{ .SetProjectID")
# Bar Load + Push
# Area Load
# General scripting guidelines
# Please stick to the following guidelines, make sure that:
# 
# - Every component is in a group;
# 
# - Every group has a colour according to the legend and
# has a group name (added as scribble);
# 
# - Wires between groups come from in/output data with
# a clear description, and are hidden;
# 
# - Wires within a group are visible;
# 
# - Add descriptions to in/outputs, sliders and other data
# containers.
# 
# Comply to this to ensure other users can read and
# understand the script
c_script = CSharpScript(x=Button())  # inputs x: Boolean
# ---------- c_script: C# usings ----------
using System.IO;
using System.Linq;
using System.Data;
using System.Drawing;
using System.Reflection;
using System.Text.RegularExpressions;
using System.Windows.Forms;
using System.Xml;
using System.Xml.Linq;
using System.Runtime.InteropServices;

using Rhino.DocObjects;
using Rhino.Collections;
using GH_IO;
using GH_IO.Serialization;
# ---------- c_script: C# ----------
    if (x)
    {
      check_canvas();
    }
    else
    {
      var msg = "Plug in a button and I will run when pressed! Don't use a boolean toggle, I work best with just a button";
      this.Component.AddRuntimeMessage(Grasshopper.Kernel.GH_RuntimeMessageLevel.Remark, msg);
    }
# ---------- c_script: C# additional code ----------
  public void check_canvas()
  {
    // method to check if there is already a panel with the correct NickName
    bool PluginPanel = false;
    var ghdoc = Component.OnPingDocument();
    string name = "Plugin Libraries Used";
    try {
      Grasshopper.Kernel.Special.GH_Panel panel = ghdoc.Objects.OfType<Grasshopper.Kernel.Special.GH_Panel>().First(p => p.NickName == name);
      if (panel.NickName == name) {
        panel.UserText = this.libraries();
        panel.ExpireSolution(true);
        PluginPanel = true;
      }
    }
    catch {
      this.Component.AddRuntimeMessage(Grasshopper.Kernel.GH_RuntimeMessageLevel.Remark, "sys.exc_info()[1].ToString() error");
    } // no idea if this runtime warning works

    // this makes a new panel and fills it, if there was no panel to begin with
    if (!(PluginPanel)) {
      var newpanel = new Grasshopper.Kernel.Special.GH_Panel();
      newpanel.CreateAttributes();
      newpanel.NickName = name;
      newpanel.UserText = this.libraries();
      newpanel.Properties.Font = new System.Drawing.Font("Segoe UI", 8);
      newpanel.Properties.Colour = System.Drawing.Color.FromArgb(227, 224, 214); //grey colour
      newpanel.Properties.Multiline = false;
      newpanel.Attributes.Pivot = new System.Drawing.PointF(-310, 910);
      newpanel.Attributes.Bounds = new System.Drawing.RectangleF(0, 0, 290, 250);
      ghdoc.AddObject(newpanel, false);
    }
  }


  public string libraries()
  {
    // this method creates a list of the plugins used that are not the part of the core of grasshopper
    var server = Grasshopper.Instances.ComponentServer;
    var Plugs = new System.Text.StringBuilder();
    Dictionary<object, string> objids = new Dictionary<object, string>();
    Dictionary<object, string> addonLibs = new Dictionary<object, string>();
    try {
      foreach (var obj in Component.OnPingDocument().Objects) {
        // gathers object information
        var objId = obj.ComponentGuid;
        // checks if objectID is already in the objectIDs list
        if (objids.ContainsKey(objId)) {
          continue;
        }
        objids.Add(objId, "");

        // gets the assembly (plugin library) of the object
        var lib = server.FindAssemblyByObject(obj);
        if (lib == null) {
          continue;
        }
        // checks if the assembly is already in the plugin list
        if (addonLibs.ContainsKey(lib.Id)) {
          continue;
        }
        // checks if the assembly is a core assembly
        if (lib.IsCoreLibrary) {
          continue;
        }
          // checks if there is a name to display
          // python component is not regonised as a core assembly
          //        if (lib.Name == "") {
          //          continue;
          //        }
          // adds the assembly to the plugin list and makes the string
        else {
          addonLibs.Add(lib.Id, "");
          // remove empty last line
          if (addonLibs.Count > 1) {
            Plugs.Append("\n");
          }
          // add name and version of plugin
          if (lib.Name != null) {
            Plugs.Append(lib.Name + " | ver: " + lib.Version);
          }
        }
      }
    }
    catch {
      this.Component.AddRuntimeMessage(Grasshopper.Kernel.GH_RuntimeMessageLevel.Remark, "sys.exc_info()[1].ToString() error");
    }
    return  Plugs.ToString();
  }
# ---------- end c_script ----------
date = Panel("19-01-2024")
date_2 = Panel("xx-xx-xxxx")
script_description = Panel("Description ...")
# RFEM6_Toolkit_Hack_Session_Full_Script
# LEGEND
# Input
revision = Panel("P03")
# Base + Top Circle
# Bar Line + Panel + Opening Definition
# BHoMify Compnents
# Geometry Push To RFEM6
# Nodal Loads + Push
# LineLoad + FreeLineLoad + Push
signed = Panel("")

# ---- group: Parameters 1 - Geometry
# Input
shifts = Slider(3, range=0..10)
supports = Slider(9, range=2..20)
height = Slider(50, range=0..100)
base_radius = Slider(10, range=0..10)
top_radius = Slider(10, range=0..10)
panel_position = Slider(40, range=0..50)

# ---- group: Parameters 2 - BHoM
concrete = Concrete(
    {"C12/15": 0, "C16/20": 1, "C20/25": 2, "C25/30": 3, "C30/37": 4, "C35/45": 5, "C40/50": 6, "C45/55": 7, "C50/60": 8, "C55/67": 9, "C60/75": 10, "C70/85": 11, "C80/95": 12, "C90/105": 13}, selected="C12/15",
    Component="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",
    Selection=0)
concrete_2 = Concrete(
    {"C12/15": 0, "C16/20": 1, "C20/25": 2, "C25/30": 3, "C30/37": 4, "C35/45": 5, "C40/50": 6, "C45/55": 7, "C50/60": 8, "C55/67": 9, "C60/75": 10, "C70/85": 11, "C80/95": 12, "C90/105": 13}, selected="C12/15",
    Component="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",
    Selection=0)
concrete_3 = Concrete(
    {"C12/15": 0, "C16/20": 1, "C20/25": 2, "C25/30": 3, "C30/37": 4, "C35/45": 5, "C40/50": 6, "C45/55": 7, "C50/60": 8, "C55/67": 9, "C60/75": 10, "C70/85": 11, "C80/95": 12, "C90/105": 13}, selected="C12/15",
    Component="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",
    Selection=0)
diameter_inclined_bars = Slider(0.7, range=0..1)
section_diameter_top_ring = Slider(0.6, range=0..1)
panel_thickness = Slider(0.5, range=0..1)

# ----
# Base + Top Circle
num = Number(supports)
num_2 = Number(base_radius)
num_3 = Number(height)
num_4 = Number(top_radius)

# ---- group: Base Circle + Split
pt = ConstructPoint(XCoordinate=0, YCoordinate=0, ZCoordinate=0)
cir = Circle(Plane=pt, Radius=num_2)
divide = DivideCurve(Curve=cir, Count=num, Kinks=False)  # -> Points, Tangents, Parameters

# ---- group: Top Circle + Split
pt_2 = ConstructPoint(XCoordinate=0, YCoordinate=0, ZCoordinate=num_3)
cir_2 = Circle(Plane=pt_2, Radius=num_4)
divide_2 = DivideCurve(Curve=cir_2, Count=num, Kinks=False)  # -> Points, Tangents, Parameters

# ----
geo = Geometry(divide.Points)
geo_2 = Geometry(divide_2.Points)

# ----
# Bar Line + Panel + Opening Definition
geo_3 = Geometry(geo)
geo_4 = Geometry(geo_2)

num_5 = Number(shifts)
num_6 = Number(panel_position)

num_7 = Number(num_5)
geo_5 = Geometry(geo_4)
neg = Negative(Value=num_5)
geo_6 = Geometry(geo_4)
shift = ShiftList(List=geo_6, Shift=num_7, Wrap=True)
shift_2 = ShiftList(List=geo_5, Shift=neg, Wrap=True)
geo_7 = Geometry(geo_3)
geo_8 = Geometry(geo)
ln = Line(StartPoint=geo_7, EndPoint=shift)
ln_2 = Line(StartPoint=geo_8, EndPoint=shift_2)
crv = Curve(ln)
crv_2 = Curve(ln_2)

pline = PolyLine(Vertices=geo_4, Closed=Toggle(True))
explode = Explode(Curve=pline, Recursive=True)  # -> Segments, Vertices
crv_3 = Curve(explode.Segments)

merge = Merge(Data1=crv_2, Data2=crv, Data3=crv_3)
bbox = BoundingBox(Content=merge, Plane=PlaneXY(0, 0, 0), UnionBox=True)  # -> Box, Box_2
debox = DeconstructBox(Box=bbox.Box)  # -> Plane, X, Y, Z
rectangle = Rectangle(Plane=debox.Plane, XSize=debox.X, YSize=debox.Y, Radius=0)  # -> Rectangle, Length
num_8 = Number(num_6)
Z = UnitZ(Factor=num_8)
srf = Surface(rectangle.Rectangle)
move = Move(Geometry=srf, Motion=Z)  # -> Geometry, Transform
blx = BrepLine(Brep=move.Geometry, Line=[crv_2, crv], LimitToFirst=False)  # -> Curves, flatten(Points)
cset = CreateSet(List=blx.Points)  # -> Set, Map
alongcrv = SortAlongCurve(Points=cset.Set, Curve=srf)  # -> Points, Indices
pline_2 = PolyLine(Vertices=alongcrv.Points, Closed=Toggle(True))
crv_4 = Curve(pline_2)

crv_5 = Curve(pline_2)
bbox_2 = BoundingBox(Content=crv_5, Plane=PlaneXY(0, 0, 0))  # -> Box, Box_2
area = Area(Geometry=crv_5)  # -> Area, Centroid
debox_2 = DeconstructBox(Box=bbox_2.Box)  # -> Plane, X, Y, Z
num_9 = Number(debox_2.X)
division = Division(A=num_9, B="2")
cir_3 = Circle(Plane=area.Centroid, Radius=division)
scale = Scale(Geometry=cir_3, Center=area.Centroid, Factor=0.5)  # -> Geometry, Transform
geo_9 = Geometry(scale.Geometry)

geo_10 = Geometry(geo_3)
pline_3 = PolyLine(Vertices=geo_10, Closed=Toggle(True))

crv_6 = Curve(crv_2)
geo_11 = Geometry(crv_4)
crv_7 = Curve(crv_3)
geo_12 = Geometry(geo_9)
crv_8 = Curve(crv)
geo_13 = Geometry(pline_3)

top_surface_outline = Geometry(geo_11)
bars = Curve(crv_8)
bottom_panel_outline = Geometry(geo_13)
# BHoMify Compnents
bars_2 = Curve(crv_6)
top_bars_lines = Curve(crv_7)
top_panel_opening_outline = Geometry(geo_12)

num_10 = Number(panel_thickness)
bhom = BHoMObject(
    concrete_2,
    ObjectType="{ \"_t\" : \"System.Type\", \"Name\" : \"System.Object, mscorlib, Version=4.0.0.0, Culture=neutral, PublicKeyToken=b77a5c561934e089\", \"_bhomVersion\" : \"7.2\" }",
    m_ForcePreview=False,
    m_MaxItemsPreview=10000)
bhom_2 = BHoMObject(
    concrete_3,
    ObjectType="{ \"_t\" : \"System.Type\", \"Name\" : \"System.Object, mscorlib, Version=4.0.0.0, Culture=neutral, PublicKeyToken=b77a5c561934e089\", \"_bhomVersion\" : \"7.2\" }",
    m_ForcePreview=False,
    m_MaxItemsPreview=10000)

sawntimber = SawnTimber(
    {"C14": 0, "C16": 1, "C18": 2, "C20": 3, "C22": 4, "C24": 5, "C27": 6, "C30": 7, "C35": 8, "C40": 9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}, selected="C30",
    Component="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",
    Selection=7)
circleprofile = CircleProfile(Diameter=Slider(0.8, range=0..1), Component="{ .CircleProfile")
crv_9 = Curve(bars_2)
genericsectionfromprofile = GenericSectionFromProfile(Profile=circleprofile, Material=sawntimber, Component="{ .GenericSectionFromProfile")
bar = Bar(
    Line=crv_9,
    SectionProperty=genericsectionfromprofile,
    OrientationAngle=0,
    FeaType="{ \"_t\" : \"System.Enum\", \"TypeName\" : { \"_t\" : \"System.Type\", \"Name\" : \"BH.oM.Structure.Elements.BarFEAType\", \"_bhomVersion\" : \"7.2\" }, \"Value\" : \"Flexural\", \"_bhomVersion\" : \"7.2\" }",
    Name="BarTimber",
    Component="{ .Bar")

circleprofile_2 = CircleProfile(Diameter=Slider(0.8, range=0..1), Component="{ .CircleProfile")
crv_10 = Curve(bars)
glulam = Glulam(
    {"GL 20c": 0, "GL 22c": 1, "GL 24c": 2, "GL 26c": 3, "GL 28c": 4, "GL 30c": 5, "GL 32c": 6, "GL 20h": 7, "GL 22h": 8, "GL 24h": 9, "GL 26h": 10, "GL 28h": 11, "GL 30h": 12, "GL 32h": 13}, selected="GL 20c",
    Component="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",
    Selection=0)
genericsectionfromprofile_2 = GenericSectionFromProfile(Profile=circleprofile_2, Material=glulam, Component="{ .GenericSectionFromProfile")
bar_2 = Bar(
    Line=crv_10,
    SectionProperty=genericsectionfromprofile_2,
    OrientationAngle=0,
    FeaType="{ \"_t\" : \"System.Enum\", \"TypeName\" : { \"_t\" : \"System.Type\", \"Name\" : \"BH.oM.Structure.Elements.BarFEAType\", \"_bhomVersion\" : \"7.2\" }, \"Value\" : \"Flexural\", \"_bhomVersion\" : \"7.2\" }",
    Name="BarTimber",
    Component="{ .Bar")

crv_11 = Curve(bars_2)
end = EndPoints(Curve=crv_11)  # -> Start, End
pinconstraint6dof = PinConstraint6DOF(Name="Pin", Component="{ .PinConstraint6DOF")
pt_3 = Point(end.Start)
node = Node(Coordinates=pt_3, Support=pinconstraint6dof, Component="{ .Node")

num_11 = Number(section_diameter_top_ring)
bhom_3 = BHoMObject(
    concrete_2,
    ObjectType="{ \"_t\" : \"System.Type\", \"Name\" : \"System.Object, mscorlib, Version=4.0.0.0, Culture=neutral, PublicKeyToken=b77a5c561934e089\", \"_bhomVersion\" : \"7.2\" }",
    m_ForcePreview=False,
    m_MaxItemsPreview=10000)
concretecircularsection = ConcreteCircularSection(Diameter=num_11, Material=bhom_3, Component="{ .ConcreteCircularSection")
crv_12 = Curve(top_bars_lines)
bar_3 = Bar(
    Line=crv_12,
    SectionProperty=concretecircularsection,
    FeaType="{ \"_t\" : \"System.Enum\", \"TypeName\" : { \"_t\" : \"System.Type\", \"Name\" : \"BH.oM.Structure.Elements.BarFEAType\", \"_bhomVersion\" : \"7.2\" }, \"Value\" : \"Flexural\", \"_bhomVersion\" : \"7.2\" }",
    Component="{ .Bar")

num_12 = Number(num_10)
bhom_4 = BHoMObject(
    bhom_2,
    ObjectType="{ \"_t\" : \"System.Type\", \"Name\" : \"System.Object, mscorlib, Version=4.0.0.0, Culture=neutral, PublicKeyToken=b77a5c561934e089\", \"_bhomVersion\" : \"7.2\" }",
    m_ForcePreview=False,
    m_MaxItemsPreview=10000)
constantthickness = ConstantThickness(
    Thickness=num_12,
    Material=bhom_4,
    PanelType="{ \"_t\" : \"System.Enum\", \"TypeName\" : { \"_t\" : \"System.Type\", \"Name\" : \"BH.oM.Structure.SurfaceProperties.PanelType\", \"_bhomVersion\" : \"7.2\" }, \"Value\" : \"Slab\", \"_bhomVersion\" : \"7.2\" }",
    Component="BH.oM.Structure.SurfaceProperties.ConstantThickness")
bottom_panel_outline_2 = Geometry(bottom_panel_outline)
panel = Panel(Outline=bottom_panel_outline_2, Property=constantthickness, Tolerance=1e-06, Component="{ .Panel")

num_13 = Number(num_10)
bhom_5 = BHoMObject(
    bhom_2,
    ObjectType="{ \"_t\" : \"System.Type\", \"Name\" : \"System.Object, mscorlib, Version=4.0.0.0, Culture=neutral, PublicKeyToken=b77a5c561934e089\", \"_bhomVersion\" : \"7.2\" }",
    m_ForcePreview=False,
    m_MaxItemsPreview=10000)
top_surface_outline_2 = Geometry(top_surface_outline)
top_panel_opening_outline_2 = Geometry(top_panel_opening_outline)
constantthickness_2 = ConstantThickness(
    Thickness=num_13,
    Material=bhom_5,
    PanelType="{ \"_t\" : \"System.Enum\", \"TypeName\" : { \"_t\" : \"System.Type\", \"Name\" : \"BH.oM.Structure.SurfaceProperties.PanelType\", \"_bhomVersion\" : \"7.2\" }, \"Value\" : \"Slab\", \"_bhomVersion\" : \"7.2\" }",
    Component="BH.oM.Structure.SurfaceProperties.ConstantThickness")
panel_2 = Panel(
    Outline=top_surface_outline_2,
    Openings=top_panel_opening_outline_2,
    Property=constantthickness_2,
    Tolerance=1e-06,
    Component="{ .Panel")

bhom_6 = BHoMObject(
    flatten([bar_2, bar, bar_3, node, panel_2, panel]),
    ObjectType="{ \"_t\" : \"System.Type\", \"Name\" : \"System.Object, mscorlib, Version=4.0.0.0, Culture=neutral, PublicKeyToken=b77a5c561934e089\", \"_bhomVersion\" : \"7.2\" }",
    m_ForcePreview=False,
    m_MaxItemsPreview=10000)
# Geometry Push To RFEM6
bhom_7 = BHoMObject(
    bhom_6,
    ObjectType="{ \"_t\" : \"System.Type\", \"Name\" : \"System.Object, mscorlib, Version=4.0.0.0, Culture=neutral, PublicKeyToken=b77a5c561934e089\", \"_bhomVersion\" : \"7.2\" }",
    m_ForcePreview=False,
    m_MaxItemsPreview=10000)

toggle = BooleanToggle(False)
rfem6adapter = RFEM6Adapter(Active=toggle, Component="{ ..ctor")
push = Push(
    Adapter=rfem6adapter,
    Objects=flatten(bhom_7),
    PushType="{ \"_t\" : \"System.Enum\", \"TypeName\" : { \"_t\" : \"System.Type\", \"Name\" : \"BH.oM.Adapter.PushType\", \"_bhomVersion\" : \"7.2\" }, \"Value\" : \"AdapterDefault\", \"_bhomVersion\" : \"7.2\" }",
    Active=toggle,
    Component="{ .Push")  # -> Objects, Success

# ---- group: Generating Random Nodes on Geometry
# Nodal Loads + Push
srf_2 = Surface(panel_2)
popgeo = PopulateGeometry(Geometry=srf_2, Count=Slider(8, range=0..10), Seed=1)
pt_4 = Point(popgeo)

# ----
loadaxis = LoadAxis({"Global": 0, "Local": 1}, selected="Global", Component="BH.oM.Structure.Loads.LoadAxis", Selection=0)

# ---- group: BHoM PointLoad Definition
list = ValueList({"X-Vec": 0, "Y-Vec": 1, "Z-Vec": 2, "X-Vec_Rev": 3, "Y-Vec_Rev": 4, "Z-Vec_Rev": 5}, selected="Z-Vec_Rev")
loadnature = LoadNature(
    {"Dead": 0, "SuperDead": 1, "Live": 2, "Wind": 3, "Seismic": 4, "Temperature": 5, "Snow": 6, "Accidental": 7, "Prestress": 8, "Notional": 9, "Other": 10}, selected="Dead",
    Component="BH.oM.Structure.Loads.LoadNature",
    Selection=0)
cluster = Cluster(num=list)
loadcase = Loadcase(Nature=loadnature, Number=Slider(1, range=0..1), Component="BH.oM.Structure.Loads.Loadcase")
vec = Vector(cluster)
node_2 = Node(Coordinates=pt_4, Component="{ .Node")
createtype = CreateType(Component="BH.oM.Structure.Elements.Node")
bhomgroup = BHoMGroup(Elements=node_2, Type=createtype, Component="{ .BHoMGroup")
pointload = PointLoad(Loadcase=loadcase, Group=bhomgroup, Force=vec, Axis=loadaxis, Component="{ .PointLoad")

# ---- group: Push Nodal Loads
toggle_2 = BooleanToggle(False)
rfem6adapter_2 = RFEM6Adapter(Active=toggle_2, Component="{ ..ctor")
push_2 = Push(
    Adapter=rfem6adapter_2,
    Objects=flatten(pointload),
    PushType="{ \"_t\" : \"System.Enum\", \"TypeName\" : { \"_t\" : \"System.Type\", \"Name\" : \"BH.oM.Adapter.PushType\", \"_bhomVersion\" : \"7.2\" }, \"Value\" : \"AdapterDefault\", \"_bhomVersion\" : \"7.2\" }",
    Active=toggle_2,
    Component="{ .Push")  # -> Objects, Success

# ---- group: Specifying On which area load will be applied
# LineLoad + FreeLineLoad + Push
# Comments on Non-FreeLineloads: #########################################
# 
# 1. LineLoads are GeometricalLineLoads in BHoM
# 
# 2. Loads always need to be Axis Parallel
# 
# 3. Do not mix Moments + Forces in the BHoM/GH components!!!
# 
# 4. Location Referres to existing lines in RFEM6
# 
# #########################################
bhom_8 = BHoMObject(
    flatten([panel_2, panel]),
    ObjectType="{ \"_t\" : \"System.Type\", \"Name\" : \"System.Object, mscorlib, Version=4.0.0.0, Culture=neutral, PublicKeyToken=b77a5c561934e089\", \"_bhomVersion\" : \"7.2\" }",
    m_ForcePreview=False,
    m_MaxItemsPreview=10000)
item = ListItem(List=bhom_8, Index=Slider(0, range=0..1), Wrap=True)
createtype_2 = CreateType(Component="BH.oM.Structure.Elements.IAreaElement")
bhomgroup_2 = BHoMGroup(Elements=flatten(item), Type=createtype_2, Component="{ .BHoMGroup")

# ---- group: Definition Load Case
loadnature_2 = LoadNature(
    {"Dead": 0, "SuperDead": 1, "Live": 2, "Wind": 3, "Seismic": 4, "Temperature": 5, "Snow": 6, "Accidental": 7, "Prestress": 8, "Notional": 9, "Other": 10}, selected="Wind",
    Component="BH.oM.Structure.Loads.LoadNature",
    Selection=3)
loadcase_2 = Loadcase(Nature=loadnature_2, Number=Slider(6, range=0..10), Component="BH.oM.Structure.Loads.Loadcase")

# ---- group: Free Line Load Location
geo_14 = Geometry(top_surface_outline)
explode_2 = Explode(Curve=geo_14, Recursive=True)  # -> Segments, Vertices
lng = ListLength(List=explode_2.Segments)
division_2 = Division(A=lng, B="2")
split = SplitList(List=explode_2.Segments, Index=division_2)  # -> ListA, ListB

# ---- group: Definition Non-Free LineLoad
list_2 = ValueList({"X-Vec": 0, "Y-Vec": 1, "Z-Vec": 2, "X-Vec_Rev": 3, "Y-Vec_Rev": 4, "Z-Vec_Rev": 5}, selected="Z-Vec_Rev")
cluster_2 = Cluster(num=list_2)
vec_2 = Vector(cluster_2)
geometricallineload = GeometricalLineLoad(Location=split.ListA, Loadcase=loadcase_2, Force=vec_2, Component="{ .GeometricalLineLoad")
loadaxis_2 = LoadAxis({"Global": 0, "Local": 1}, selected="Global", Component="BH.oM.Structure.Loads.LoadAxis", Selection=0)
# Non - Free LineLoad
setproperty = SetProperty(Obj=geometricallineload, PropName="Axis", Value=loadaxis_2, Component="{ .SetPropertyValue")
geometricallineloadtypesenum = GeometricalLineLoadTypesEnum(
    {"FreeLineLoad": 0, "NonFreeLineLoad": 1}, selected="NonFreeLineLoad",
    Component="BH.oM.Adapters.RFEM6.Fragments.Enums.GeometricalLineLoadTypesEnum",
    Selection=1)
rfem6geometricallineloadtypes = RFEM6GeometricalLineLoadTypes(
    GeometrialLineLoadType=geometricallineloadtypesenum,
    Component="BH.oM.Adapters.RFEM6.BHoMDataStructure.SupportDatastrures.RFEM6GeometricalLineLoadTypes")
addfragment = AddFragment(IBHoMObject=flatten(setproperty), Fragment=rfem6geometricallineloadtypes, Replace=False, Component="{ .AddFragment")

list_3 = ValueList({"X-Vec": 0, "Y-Vec": 1, "Z-Vec": 2, "X-Vec_Rev": 3, "Y-Vec_Rev": 4, "Z-Vec_Rev": 5}, selected="X-Vec")
cluster_3 = Cluster(num=list_3)
vec_3 = Vector(cluster_3)
loadaxis_3 = LoadAxis({"Global": 0, "Local": 1}, selected="Global", Component="BH.oM.Structure.Loads.LoadAxis", Selection=0)
rev = Reverse(Vector=vec_3)
geometricallineload_2 = GeometricalLineLoad(
    Loadcase=loadcase_2,
    Axis=loadaxis_3,
    Projected=Toggle(True),
    ForceA="{ \"_t\" : \"BH.oM.Geometry.Vector\", \"X\" : 0.0, \"Y\" : 0.0, \"Z\" : 0.0, \"_bhomVersion\" : \"7.2\" }",
    ForceB="{ \"_t\" : \"BH.oM.Geometry.Vector\", \"X\" : 0.0, \"Y\" : 0.0, \"Z\" : 0.0, \"_bhomVersion\" : \"7.2\" }",
    MomentA=vec_3,
    MomentB=rev,
    Location=split.ListB,
    Objects="{ \"_t\" : \"BH.oM.Base.BHoMGroup`1[[BH.oM.Structure.Elements.IAreaElement, Structure_oM, Version=7.0.0.0, Culture=neutral, PublicKeyToken=null]]\", \"Elements\" : [], \"BHoM_Guid\" : \"8408896e-2d24-405e-b3fc-15b7d8c52efa\", \"_bhomVersion\" : \"7.2\" }",
    Component="BH.oM.Structure.Loads.GeometricalLineLoad")
geometricallineloadtypesenum_2 = GeometricalLineLoadTypesEnum(
    {"FreeLineLoad": 0, "NonFreeLineLoad": 1}, selected="NonFreeLineLoad",
    Component="BH.oM.Adapters.RFEM6.Fragments.Enums.GeometricalLineLoadTypesEnum",
    Selection=1)
rfem6geometricallineloadtypes_2 = RFEM6GeometricalLineLoadTypes(
    GeometrialLineLoadType=geometricallineloadtypesenum_2,
    Component="BH.oM.Adapters.RFEM6.BHoMDataStructure.SupportDatastrures.RFEM6GeometricalLineLoadTypes")
addfragment_2 = AddFragment(
    IBHoMObject=flatten(geometricallineload_2),
    Fragment=rfem6geometricallineloadtypes_2,
    Replace=False,
    Component="{ .AddFragment")

# ---- group: Definition Free Line Load
# Free LineLoad
list_4 = ValueList({"X-Vec": 0, "Y-Vec": 1, "Z-Vec": 2, "X-Vec_Rev": 3, "Y-Vec_Rev": 4, "Z-Vec_Rev": 5}, selected="Z-Vec")
cluster_4 = Cluster(num=list_4)
vec_4 = Vector(cluster_4)
rev_2 = Reverse(Vector=vec_4)
loadaxis_4 = LoadAxis({"Global": 0, "Local": 1}, selected="Global", Component="BH.oM.Structure.Loads.LoadAxis", Selection=0)
crv_13 = Curve(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)
geometricallineload_3 = GeometricalLineLoad(
    Loadcase=loadcase_2,
    Axis=loadaxis_4,
    Projected=Toggle(False),
    ForceA=vec_4,
    ForceB=rev_2,
    MomentA="{ \"_t\" : \"BH.oM.Geometry.Vector\", \"X\" : 0.0, \"Y\" : 0.0, \"Z\" : 0.0, \"_bhomVersion\" : \"7.2\" }",
    MomentB="{ \"_t\" : \"BH.oM.Geometry.Vector\", \"X\" : 0.0, \"Y\" : 0.0, \"Z\" : 0.0, \"_bhomVersion\" : \"7.2\" }",
    Location=crv_13,
    Objects=bhomgroup_2,
    Component="BH.oM.Structure.Loads.GeometricalLineLoad")

# ---- group: Push
toggle_3 = BooleanToggle(False)
rfem6adapter_3 = RFEM6Adapter(Active=toggle_3, Component="{ ..ctor")
merge_2 = Merge(Data1=addfragment, Data2=addfragment_2, Data3=geometricallineload_3)
push_3 = Push(
    Adapter=rfem6adapter_3,
    Objects=flatten(merge_2),
    PushType="{ \"_t\" : \"System.Enum\", \"TypeName\" : { \"_t\" : \"System.Type\", \"Name\" : \"BH.oM.Adapter.PushType\", \"_bhomVersion\" : \"7.2\" }, \"Value\" : \"AdapterDefault\", \"_bhomVersion\" : \"7.2\" }",
    Active=toggle_3,
    Component="{ .Push")  # -> Objects, Success

# ---- group: Bar Proj. Load
# Bar Load + Push
bhom_9 = BHoMObject(
    bar_2,
    ObjectType="{ \"_t\" : \"System.Type\", \"Name\" : \"System.Object, mscorlib, Version=4.0.0.0, Culture=neutral, PublicKeyToken=b77a5c561934e089\", \"_bhomVersion\" : \"7.2\" }",
    m_ForcePreview=False,
    m_MaxItemsPreview=10000)
item_2 = ListItem(List=bhom_9, Index=0, Wrap=True)

# ---- group: Bar Non Proj Load
bhom_10 = BHoMObject(
    bar,
    ObjectType="{ \"_t\" : \"System.Type\", \"Name\" : \"System.Object, mscorlib, Version=4.0.0.0, Culture=neutral, PublicKeyToken=b77a5c561934e089\", \"_bhomVersion\" : \"7.2\" }",
    m_ForcePreview=False,
    m_MaxItemsPreview=10000)
item_3 = ListItem(List=bhom_10, Index=0, Wrap=True)

# ----
loadnature_3 = LoadNature(
    {"Dead": 0, "SuperDead": 1, "Live": 2, "Wind": 3, "Seismic": 4, "Temperature": 5, "Snow": 6, "Accidental": 7, "Prestress": 8, "Notional": 9, "Other": 10}, selected="Dead",
    Component="BH.oM.Structure.Loads.LoadNature",
    Selection=0)
loadcase_3 = Loadcase(Nature=loadnature_3, Number=Slider(3, range=0..10), Component="BH.oM.Structure.Loads.Loadcase")

createtype_3 = CreateType(Component="BH.oM.Structure.Elements.Bar")
list_5 = ValueList({"X-Vec": 0, "Y-Vec": 1, "Z-Vec": 2, "X-Vec_Rev": 3, "Y-Vec_Rev": 4, "Z-Vec_Rev": 5}, selected="Z-Vec_Rev")
bhomgroup_3 = BHoMGroup(Elements=item_2, Type=createtype_3, Component="{ .BHoMGroup")
cluster_5 = Cluster(num=list_5)
loadaxis_5 = LoadAxis({"Global": 0, "Local": 1}, selected="Global", Component="BH.oM.Structure.Loads.LoadAxis", Selection=0)
vec_5 = Vector(cluster_5)
baruniformlydistributedload = BarUniformlyDistributedLoad(
    Force=vec_5,
    Moment="{ \"_t\" : \"BH.oM.Geometry.Vector\", \"X\" : 0.0, \"Y\" : 0.0, \"Z\" : 0.0, \"_bhomVersion\" : \"7.2\" }",
    Loadcase=loadcase_3,
    Objects=bhomgroup_3,
    Axis=loadaxis_5,
    Projected=Toggle(True),
    Component="BH.oM.Structure.Loads.BarUniformlyDistributedLoad")

createtype_4 = CreateType(Component="BH.oM.Structure.Elements.Bar")
bhomgroup_4 = BHoMGroup(Elements=item_3, Type=createtype_4, Component="{ .BHoMGroup")
list_6 = ValueList({"X-Vec": 0, "Y-Vec": 1, "Z-Vec": 2, "X-Vec_Rev": 3, "Y-Vec_Rev": 4, "Z-Vec_Rev": 5}, selected="Z-Vec_Rev")
cluster_6 = Cluster(num=list_6)
loadaxis_6 = LoadAxis({"Global": 0, "Local": 1}, selected="Global", Component="BH.oM.Structure.Loads.LoadAxis", Selection=0)
vec_6 = Vector(cluster_6)
baruniformlydistributedload_2 = BarUniformlyDistributedLoad(
    Force=vec_6,
    Moment="{ \"_t\" : \"BH.oM.Geometry.Vector\", \"X\" : 0.0, \"Y\" : 0.0, \"Z\" : 0.0, \"_bhomVersion\" : \"7.2\" }",
    Loadcase=loadcase_3,
    Objects=bhomgroup_4,
    Axis=loadaxis_6,
    Projected=Toggle(False),
    Component="BH.oM.Structure.Loads.BarUniformlyDistributedLoad")

# ---- group: Push
toggle_4 = BooleanToggle(False)
rfem6adapter_4 = RFEM6Adapter(Active=toggle_4, Component="{ ..ctor")
push_4 = Push(
    Adapter=rfem6adapter_4,
    Objects=flatten([baruniformlydistributedload_2, baruniformlydistributedload]),
    PushType="{ \"_t\" : \"System.Enum\", \"TypeName\" : { \"_t\" : \"System.Type\", \"Name\" : \"BH.oM.Adapter.PushType\", \"_bhomVersion\" : \"7.2\" }, \"Value\" : \"AdapterDefault\", \"_bhomVersion\" : \"7.2\" }",
    Active=toggle_4,
    Component="{ .Push")  # -> Objects, Success

# ----
loadnature_4 = LoadNature(
    {"Dead": 0, "SuperDead": 1, "Live": 2, "Wind": 3, "Seismic": 4, "Temperature": 5, "Snow": 6, "Accidental": 7, "Prestress": 8, "Notional": 9, "Other": 10}, selected="SuperDead",
    Component="BH.oM.Structure.Loads.LoadNature",
    Selection=1)
list_7 = ValueList({"X-Vec": 0, "Y-Vec": 1, "Z-Vec": 2, "X-Vec_Rev": 3, "Y-Vec_Rev": 4, "Z-Vec_Rev": 5}, selected="Y-Vec_Rev")
# Area Load
panel_3 = Panel("Random Name")
cluster_7 = Cluster(num=list_7)
loadaxis_7 = LoadAxis({"Global": 0, "Local": 1}, selected="Global", Component="BH.oM.Structure.Loads.LoadAxis", Selection=0)
loadcase_4 = Loadcase(Name=panel_3, Nature=loadnature_4, Number=Slider(12, range=0..100), Component="BH.oM.Structure.Loads.Loadcase")
vec_7 = Vector(cluster_7)
bhom_11 = BHoMObject(
    panel_2,
    ObjectType="{ \"_t\" : \"System.Type\", \"Name\" : \"System.Object, mscorlib, Version=4.0.0.0, Culture=neutral, PublicKeyToken=b77a5c561934e089\", \"_bhomVersion\" : \"7.2\" }",
    m_ForcePreview=False,
    m_MaxItemsPreview=10000)
areauniformlydistributedload = AreaUniformlyDistributedLoad(
    Loadcase=loadcase_4,
    Pressure=vec_7,
    Objects=bhom_11,
    Axis=loadaxis_7,
    Projected=False,
    Component="{ .AreaUniformlyDistributedLoad")

# ---- group: Push
toggle_5 = BooleanToggle(False)
rfem6adapter_5 = RFEM6Adapter(Active=toggle_5, Component="{ ..ctor")
push_5 = Push(
    Adapter=rfem6adapter_5,
    Objects=flatten(areauniformlydistributedload),
    PushType="{ \"_t\" : \"System.Enum\", \"TypeName\" : { \"_t\" : \"System.Type\", \"Name\" : \"BH.oM.Adapter.PushType\", \"_bhomVersion\" : \"7.2\" }, \"Value\" : \"AdapterDefault\", \"_bhomVersion\" : \"7.2\" }",
    Active=toggle_5,
    Component="{ .Push")  # -> Objects, Success

# ----
panel_4 = Panel("""1
2
3
4
5
6
7
8
9""")
noderesulttype = NodeResultType(
    {"NodeReaction": 0, "NodeDisplacement": 1, "NodeVelocity": 2, "NodeAcceleration": 3, "NodeModalMass": 4, "NodeModeShape": 5, "NodeModalResult": 6}, selected="NodeReaction",
    Component="BH.oM.Structure.Requests.NodeResultType",
    Selection=0)
noderesultrequest = NodeResultRequest(
    ResultType=noderesulttype,
    Axis="{ \"_t\" : \"System.Enum\", \"TypeName\" : { \"_t\" : \"System.Type\", \"Name\" : \"BH.oM.Structure.Loads.LoadAxis\", \"_bhomVersion\" : \"7.2\" }, \"Value\" : \"Global\", \"_bhomVersion\" : \"7.2\" }",
    Cases="12",
    ObjectIds=panel_4,
    Component="BH.oM.Structure.Requests.NodeResultRequest")

# ----
# Read Node Reactions
# Reading Node Reaction From Nodal Supports:
# 1. Determine Node Ids to corresponding Supports
# 
# 2. Apply Setting Provided In Cheat Sheet Script
# 
# 3. Pull Result
toggle_6 = BooleanToggle(False)
rfem6adapter_6 = RFEM6Adapter(Active=toggle_6, Component="{ ..ctor")
pull = Pull(
    Adapter=rfem6adapter_6,
    Request=noderesultrequest,
    PullType="{ \"_t\" : \"System.Enum\", \"TypeName\" : { \"_t\" : \"System.Type\", \"Name\" : \"BH.oM.Adapter.PullType\", \"_bhomVersion\" : \"7.2\" }, \"Value\" : \"AdapterDefault\", \"_bhomVersion\" : \"7.2\" }",
    Active=toggle_6,
    Component="{ .Pull")

data = Data(push.Objects)  # disabled
panel_5 = Panel(".")  # disabled
split_2 = TextSplit(Text=data, Separators=panel_5)  # disabled
panel_6 = Panel("-1")  # disabled
item_4 = ListItem(List=split_2, Index=panel_6, Wrap=True)  # -> flatten(Item); disabled
panel_7 = Panel("Node")  # disabled
python = GhPythonScript(x=item_4, y=panel_7)  # -> a; disabled
# ---------- python: Python ----------
__author__ = "amartensen"
__version__ = "2024.06.27"

import rhinoscriptsyntax as rs
a = (x == y)
# ---------- end python ----------
cull = CullPattern(List=data, CullPattern=python)  # disabled
number_slider = Slider(1, range=0..10)  # disabled
explode_3 = Explode(Object=cull, Component="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")  # -> Position, Orientation, Support, BHoM_Guid, Name, Fragments, Tags, CustomData; disabled
panel_8 = Panel(pull)
explode_4 = Explode(Object=pull, Component="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")  # -> FX, FY, FZ, MX, MY, MZ, ObjectId, ResultCase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
item_5 = ListItem(List=explode_3.Fragments, Index=number_slider, Wrap=True)  # disabled
explode_5 = Explode(Object=item_5, Component="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")  # -> flatten(Id); disabled
panel_9 = Panel(explode_5)  # disabled
panel_10 = Panel(explode_4.FX)
panel_11 = Panel(explode_4.FY)
panel_12 = Panel(explode_4.FZ)
panel_13 = Panel(explode_4.MX)
panel_14 = Panel(explode_4.MY)
panel_15 = Panel(explode_4.MZ)

# ==== cluster Cluster
number_slider = Slider(100, range=0..100)
num = ClusterInput()
X = UnitX(Factor=number_slider)
num_2 = Number(num)
Y = UnitY(Factor=number_slider)
Z = UnitZ(Factor=number_slider)
rev = Reverse(Vector=X)
rev_2 = Reverse(Vector=Y)
rev_3 = Reverse(Vector=Z)
merge = Merge(Data1=X, Data2=Y, Data3=Z, Data4=rev, Data5=rev_2, Data6=rev_3)
item = ListItem(List=merge, Index=num_2, Wrap=True)
vec = Vector(item)
vec_2 = ClusterOutput(vec)
