# Grasshopper definition RFEM6_Toolkit_Hack_Session_Stage2.gh (Grasshopper 1.0.7)
# plug-ins: BH.UI.Grasshopper

getinfo = GetInfo(Component="{ .GetInfo")

# ----
# Plugin Libraries Used: BH.UI.Grasshopper | ver: 7.0.0.0
project_name = Panel("...")
project_number = Panel("...")
author = Panel("HvL")
units = Panel("standard - SI")
associated_rhino_file = Panel("none")
bhom_version_used_to_create = Panel("7.1")
bhom_version_currently_installed = Panel(getinfo)
setprojectid = SetProjectID(ProjectID=project_number, Component="{ .SetProjectID")
c_script = CSharpScript(x=Button())  # inputs x: Boolean
# ---------- c_script: C# usings ----------
using System.IO;
using System.Linq;
using System.Data;
using System.Drawing;
using System.Reflection;
using System.Text.RegularExpressions;
using System.Windows.Forms;
using System.Xml;
using System.Xml.Linq;
using System.Runtime.InteropServices;

using Rhino.DocObjects;
using Rhino.Collections;
using GH_IO;
using GH_IO.Serialization;
# ---------- c_script: C# ----------
    if (x)
    {
      check_canvas();
    }
    else
    {
      var msg = "Plug in a button and I will run when pressed! Don't use a boolean toggle, I work best with just a button";
      this.Component.AddRuntimeMessage(Grasshopper.Kernel.GH_RuntimeMessageLevel.Remark, msg);
    }
# ---------- c_script: C# additional code ----------
  public void check_canvas()
  {
    // method to check if there is already a panel with the correct NickName
    bool PluginPanel = false;
    var ghdoc = Component.OnPingDocument();
    string name = "Plugin Libraries Used";
    try {
      Grasshopper.Kernel.Special.GH_Panel panel = ghdoc.Objects.OfType<Grasshopper.Kernel.Special.GH_Panel>().First(p => p.NickName == name);
      if (panel.NickName == name) {
        panel.UserText = this.libraries();
        panel.ExpireSolution(true);
        PluginPanel = true;
      }
    }
    catch {
      this.Component.AddRuntimeMessage(Grasshopper.Kernel.GH_RuntimeMessageLevel.Remark, "sys.exc_info()[1].ToString() error");
    } // no idea if this runtime warning works

    // this makes a new panel and fills it, if there was no panel to begin with
    if (!(PluginPanel)) {
      var newpanel = new Grasshopper.Kernel.Special.GH_Panel();
      newpanel.CreateAttributes();
      newpanel.NickName = name;
      newpanel.UserText = this.libraries();
      newpanel.Properties.Font = new System.Drawing.Font("Segoe UI", 8);
      newpanel.Properties.Colour = System.Drawing.Color.FromArgb(227, 224, 214); //grey colour
      newpanel.Properties.Multiline = false;
      newpanel.Attributes.Pivot = new System.Drawing.PointF(-310, 910);
      newpanel.Attributes.Bounds = new System.Drawing.RectangleF(0, 0, 290, 250);
      ghdoc.AddObject(newpanel, false);
    }
  }


  public string libraries()
  {
    // this method creates a list of the plugins used that are not the part of the core of grasshopper
    var server = Grasshopper.Instances.ComponentServer;
    var Plugs = new System.Text.StringBuilder();
    Dictionary<object, string> objids = new Dictionary<object, string>();
    Dictionary<object, string> addonLibs = new Dictionary<object, string>();
    try {
      foreach (var obj in Component.OnPingDocument().Objects) {
        // gathers object information
        var objId = obj.ComponentGuid;
        // checks if objectID is already in the objectIDs list
        if (objids.ContainsKey(objId)) {
          continue;
        }
        objids.Add(objId, "");

        // gets the assembly (plugin library) of the object
        var lib = server.FindAssemblyByObject(obj);
        if (lib == null) {
          continue;
        }
        // checks if the assembly is already in the plugin list
        if (addonLibs.ContainsKey(lib.Id)) {
          continue;
        }
        // checks if the assembly is a core assembly
        if (lib.IsCoreLibrary) {
          continue;
        }
          // checks if there is a name to display
          // python component is not regonised as a core assembly
          //        if (lib.Name == "") {
          //          continue;
          //        }
          // adds the assembly to the plugin list and makes the string
        else {
          addonLibs.Add(lib.Id, "");
          // remove empty last line
          if (addonLibs.Count > 1) {
            Plugs.Append("\n");
          }
          // add name and version of plugin
          if (lib.Name != null) {
            Plugs.Append(lib.Name + " | ver: " + lib.Version);
          }
        }
      }
    }
    catch {
      this.Component.AddRuntimeMessage(Grasshopper.Kernel.GH_RuntimeMessageLevel.Remark, "sys.exc_info()[1].ToString() error");
    }
    return  Plugs.ToString();
  }
# ---------- end c_script ----------
date = Panel("19-01-2024")
date_2 = Panel("xx-xx-xxxx")
script_description = Panel("Description ...")
# RFEM6_Toolkit_Hack_Session_Stage2
# LEGEND
# Input
revision = Panel("P03")
# Base + Top Circle
# Bar Line + Panel + Opening Definition
# BHoMify Compnents
# Geometry Push To RFEM6
signed = Panel("")

# ---- group: Parameters 1 - Geometry
# Input
shifts = Slider(3, range=0..10)
supports = Slider(9, range=2..20)
height = Slider(50, range=0..100)
base_radius = Slider(10, range=0..10)
top_radius = Slider(10, range=0..10)
panel_position = Slider(40, range=0..50)

# ---- group: Parameters 2 - BHoM
diameter_inclined_bars = Slider(0.7, range=0..1)
section_diameter_top_ring = Slider(0.6, range=0..1)
panel_thickness = Slider(0.5, range=0..1)
concrete = Concrete(
    {"C12/15": 0, "C16/20": 1, "C20/25": 2, "C25/30": 3, "C30/37": 4, "C35/45": 5, "C40/50": 6, "C45/55": 7, "C50/60": 8, "C55/67": 9, "C60/75": 10, "C70/85": 11, "C80/95": 12, "C90/105": 13}, selected="C12/15",
    Component="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",
    Selection=0)
concrete_2 = Concrete(
    {"C12/15": 0, "C16/20": 1, "C20/25": 2, "C25/30": 3, "C30/37": 4, "C35/45": 5, "C40/50": 6, "C45/55": 7, "C50/60": 8, "C55/67": 9, "C60/75": 10, "C70/85": 11, "C80/95": 12, "C90/105": 13}, selected="C12/15",
    Component="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",
    Selection=0)
concrete_3 = Concrete(
    {"C12/15": 0, "C16/20": 1, "C20/25": 2, "C25/30": 3, "C30/37": 4, "C35/45": 5, "C40/50": 6, "C45/55": 7, "C50/60": 8, "C55/67": 9, "C60/75": 10, "C70/85": 11, "C80/95": 12, "C90/105": 13}, selected="C12/15",
    Component="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",
    Selection=0)

# ----
# Base + Top Circle
num = Number(supports)
num_2 = Number(base_radius)
num_3 = Number(height)
num_4 = Number(top_radius)

# ---- group: Base Circle + Split
pt = ConstructPoint(XCoordinate=0, YCoordinate=0, ZCoordinate=0)
cir = Circle(Plane=pt, Radius=num_2)
divide = DivideCurve(Curve=cir, Count=num, Kinks=False)  # -> Points, Tangents, Parameters

# ---- group: Top Circle + Split
pt_2 = ConstructPoint(XCoordinate=0, YCoordinate=0, ZCoordinate=num_3)
cir_2 = Circle(Plane=pt_2, Radius=num_4)
divide_2 = DivideCurve(Curve=cir_2, Count=num, Kinks=False)  # -> Points, Tangents, Parameters

# ----
geo = Geometry(divide.Points)
geo_2 = Geometry(divide_2.Points)

# ----
# Bar Line + Panel + Opening Definition
geo_3 = Geometry(geo)
geo_4 = Geometry(geo_2)

num_5 = Number(shifts)
num_6 = Number(panel_position)

num_7 = Number(num_5)
geo_5 = Geometry(geo_4)
neg = Negative(Value=num_5)
geo_6 = Geometry(geo_4)
shift = ShiftList(List=geo_6, Shift=num_7, Wrap=True)
shift_2 = ShiftList(List=geo_5, Shift=neg, Wrap=True)
geo_7 = Geometry(geo_3)
geo_8 = Geometry(geo)
ln = Line(StartPoint=geo_7, EndPoint=shift)
ln_2 = Line(StartPoint=geo_8, EndPoint=shift_2)
crv = Curve(ln)
crv_2 = Curve(ln_2)

pline = PolyLine(Vertices=geo_4, Closed=Toggle(True))
explode = Explode(Curve=pline, Recursive=True)  # -> Segments, Vertices
crv_3 = Curve(explode.Segments)

merge = Merge(Data1=crv_2, Data2=crv, Data3=crv_3)
bbox = BoundingBox(Content=merge, Plane=PlaneXY(0, 0, 0), UnionBox=True)  # -> Box, Box_2
debox = DeconstructBox(Box=bbox.Box)  # -> Plane, X, Y, Z
rectangle = Rectangle(Plane=debox.Plane, XSize=debox.X, YSize=debox.Y, Radius=0)  # -> Rectangle, Length
num_8 = Number(num_6)
Z = UnitZ(Factor=num_8)
srf = Surface(rectangle.Rectangle)
move = Move(Geometry=srf, Motion=Z)  # -> Geometry, Transform
blx = BrepLine(Brep=move.Geometry, Line=[crv_2, crv], LimitToFirst=False)  # -> Curves, flatten(Points)
cset = CreateSet(List=blx.Points)  # -> Set, Map
alongcrv = SortAlongCurve(Points=cset.Set, Curve=srf)  # -> Points, Indices
pline_2 = PolyLine(Vertices=alongcrv.Points, Closed=Toggle(True))
crv_4 = Curve(pline_2)

crv_5 = Curve(pline_2)
bbox_2 = BoundingBox(Content=crv_5, Plane=PlaneXY(0, 0, 0))  # -> Box, Box_2
area = Area(Geometry=crv_5)  # -> Area, Centroid
debox_2 = DeconstructBox(Box=bbox_2.Box)  # -> Plane, X, Y, Z
num_9 = Number(debox_2.X)
division = Division(A=num_9, B="2")
cir_3 = Circle(Plane=area.Centroid, Radius=division)
scale = Scale(Geometry=cir_3, Center=area.Centroid, Factor=0.5)  # -> Geometry, Transform
geo_9 = Geometry(scale.Geometry)

geo_10 = Geometry(geo_3)
pline_3 = PolyLine(Vertices=geo_10, Closed=Toggle(True))

crv_6 = Curve(crv_2)
geo_11 = Geometry(crv_4)
crv_7 = Curve(crv_3)
geo_12 = Geometry(geo_9)
crv_8 = Curve(crv)
geo_13 = Geometry(pline_3)

top_surface_outline = Geometry(geo_11)
bars = Curve(crv_8)
bottom_panel_outline = Geometry(geo_13)
# BHoMify Compnents
bars_2 = Curve(crv_6)
top_bars_lines = Curve(crv_7)
top_panel_opening_outline = Geometry(geo_12)

num_10 = Number(panel_thickness)
bhom = BHoMObject(
    concrete_2,
    ObjectType="{ \"_t\" : \"System.Type\", \"Name\" : \"System.Object, mscorlib, Version=4.0.0.0, Culture=neutral, PublicKeyToken=b77a5c561934e089\", \"_bhomVersion\" : \"7.2\" }",
    m_ForcePreview=False,
    m_MaxItemsPreview=10000)
bhom_2 = BHoMObject(
    concrete_3,
    ObjectType="{ \"_t\" : \"System.Type\", \"Name\" : \"System.Object, mscorlib, Version=4.0.0.0, Culture=neutral, PublicKeyToken=b77a5c561934e089\", \"_bhomVersion\" : \"7.2\" }",
    m_ForcePreview=False,
    m_MaxItemsPreview=10000)

sawntimber = SawnTimber(
    {"C14": 0, "C16": 1, "C18": 2, "C20": 3, "C22": 4, "C24": 5, "C27": 6, "C30": 7, "C35": 8, "C40": 9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}, selected="C30",
    Component="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",
    Selection=7)
circleprofile = CircleProfile(Diameter=Slider(0.8, range=0..1), Component="{ .CircleProfile")
crv_9 = Curve(bars_2)
genericsectionfromprofile = GenericSectionFromProfile(Profile=circleprofile, Material=sawntimber, Component="{ .GenericSectionFromProfile")
bar = Bar(
    Line=crv_9,
    SectionProperty=genericsectionfromprofile,
    OrientationAngle=0,
    FeaType="{ \"_t\" : \"System.Enum\", \"TypeName\" : { \"_t\" : \"System.Type\", \"Name\" : \"BH.oM.Structure.Elements.BarFEAType\", \"_bhomVersion\" : \"7.2\" }, \"Value\" : \"Flexural\", \"_bhomVersion\" : \"7.2\" }",
    Name="BarTimber",
    Component="{ .Bar")

circleprofile_2 = CircleProfile(Diameter=Slider(0.8, range=0..1), Component="{ .CircleProfile")
crv_10 = Curve(bars)
glulam = Glulam(
    {"GL 20c": 0, "GL 22c": 1, "GL 24c": 2, "GL 26c": 3, "GL 28c": 4, "GL 30c": 5, "GL 32c": 6, "GL 20h": 7, "GL 22h": 8, "GL 24h": 9, "GL 26h": 10, "GL 28h": 11, "GL 30h": 12, "GL 32h": 13}, selected="GL 20c",
    Component="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",
    Selection=0)
genericsectionfromprofile_2 = GenericSectionFromProfile(Profile=circleprofile_2, Material=glulam, Component="{ .GenericSectionFromProfile")
bar_2 = Bar(
    Line=crv_10,
    SectionProperty=genericsectionfromprofile_2,
    OrientationAngle=0,
    FeaType="{ \"_t\" : \"System.Enum\", \"TypeName\" : { \"_t\" : \"System.Type\", \"Name\" : \"BH.oM.Structure.Elements.BarFEAType\", \"_bhomVersion\" : \"7.2\" }, \"Value\" : \"Flexural\", \"_bhomVersion\" : \"7.2\" }",
    Name="BarTimber",
    Component="{ .Bar")

crv_11 = Curve(bars_2)
end = EndPoints(Curve=crv_11)  # -> Start, End
pinconstraint6dof = PinConstraint6DOF(Name="Pin", Component="{ .PinConstraint6DOF")
pt_3 = Point(end.Start)
node = Node(Coordinates=pt_3, Support=pinconstraint6dof, Component="{ .Node")

num_11 = Number(section_diameter_top_ring)
bhom_3 = BHoMObject(
    concrete_2,
    ObjectType="{ \"_t\" : \"System.Type\", \"Name\" : \"System.Object, mscorlib, Version=4.0.0.0, Culture=neutral, PublicKeyToken=b77a5c561934e089\", \"_bhomVersion\" : \"7.2\" }",
    m_ForcePreview=False,
    m_MaxItemsPreview=10000)
concretecircularsection = ConcreteCircularSection(Diameter=num_11, Material=bhom_3, Component="{ .ConcreteCircularSection")
crv_12 = Curve(top_bars_lines)
bar_3 = Bar(
    Line=crv_12,
    SectionProperty=concretecircularsection,
    FeaType="{ \"_t\" : \"System.Enum\", \"TypeName\" : { \"_t\" : \"System.Type\", \"Name\" : \"BH.oM.Structure.Elements.BarFEAType\", \"_bhomVersion\" : \"7.2\" }, \"Value\" : \"Flexural\", \"_bhomVersion\" : \"7.2\" }",
    Component="{ .Bar")

num_12 = Number(num_10)
bhom_4 = BHoMObject(
    bhom_2,
    ObjectType="{ \"_t\" : \"System.Type\", \"Name\" : \"System.Object, mscorlib, Version=4.0.0.0, Culture=neutral, PublicKeyToken=b77a5c561934e089\", \"_bhomVersion\" : \"7.2\" }",
    m_ForcePreview=False,
    m_MaxItemsPreview=10000)
constantthickness = ConstantThickness(
    Thickness=num_12,
    Material=bhom_4,
    PanelType="{ \"_t\" : \"System.Enum\", \"TypeName\" : { \"_t\" : \"System.Type\", \"Name\" : \"BH.oM.Structure.SurfaceProperties.PanelType\", \"_bhomVersion\" : \"7.2\" }, \"Value\" : \"Slab\", \"_bhomVersion\" : \"7.2\" }",
    Component="BH.oM.Structure.SurfaceProperties.ConstantThickness")
bottom_panel_outline_2 = Geometry(bottom_panel_outline)
panel = Panel(Outline=bottom_panel_outline_2, Property=constantthickness, Tolerance=1e-06, Component="{ .Panel")

num_13 = Number(num_10)
bhom_5 = BHoMObject(
    bhom_2,
    ObjectType="{ \"_t\" : \"System.Type\", \"Name\" : \"System.Object, mscorlib, Version=4.0.0.0, Culture=neutral, PublicKeyToken=b77a5c561934e089\", \"_bhomVersion\" : \"7.2\" }",
    m_ForcePreview=False,
    m_MaxItemsPreview=10000)
top_surface_outline_2 = Geometry(top_surface_outline)
top_panel_opening_outline_2 = Geometry(top_panel_opening_outline)
constantthickness_2 = ConstantThickness(
    Thickness=num_13,
    Material=bhom_5,
    PanelType="{ \"_t\" : \"System.Enum\", \"TypeName\" : { \"_t\" : \"System.Type\", \"Name\" : \"BH.oM.Structure.SurfaceProperties.PanelType\", \"_bhomVersion\" : \"7.2\" }, \"Value\" : \"Slab\", \"_bhomVersion\" : \"7.2\" }",
    Component="BH.oM.Structure.SurfaceProperties.ConstantThickness")
panel_2 = Panel(
    Outline=top_surface_outline_2,
    Openings=top_panel_opening_outline_2,
    Property=constantthickness_2,
    Tolerance=1e-06,
    Component="{ .Panel")

bhom_6 = BHoMObject(
    flatten([bar_2, bar, bar_3, node, panel_2, panel]),
    ObjectType="{ \"_t\" : \"System.Type\", \"Name\" : \"System.Object, mscorlib, Version=4.0.0.0, Culture=neutral, PublicKeyToken=b77a5c561934e089\", \"_bhomVersion\" : \"7.2\" }",
    m_ForcePreview=False,
    m_MaxItemsPreview=10000)
# Geometry Push To RFEM6
bhom_7 = BHoMObject(
    bhom_6,
    ObjectType="{ \"_t\" : \"System.Type\", \"Name\" : \"System.Object, mscorlib, Version=4.0.0.0, Culture=neutral, PublicKeyToken=b77a5c561934e089\", \"_bhomVersion\" : \"7.2\" }",
    m_ForcePreview=False,
    m_MaxItemsPreview=10000)

toggle = BooleanToggle(False)
rfem6adapter = RFEM6Adapter(Active=toggle, Component="{ ..ctor")
# Reading Node Reaction From Nodal Supports:
# 1. Determine Node Ids to corresponding Supports
# 
# 2. Apply Setting Provided In Cheat Sheet Script
# 
# 3. Pull Result
push = Push(
    Adapter=rfem6adapter,
    Objects=flatten(bhom_7),
    PushType="{ \"_t\" : \"System.Enum\", \"TypeName\" : { \"_t\" : \"System.Type\", \"Name\" : \"BH.oM.Adapter.PushType\", \"_bhomVersion\" : \"7.2\" }, \"Value\" : \"AdapterDefault\", \"_bhomVersion\" : \"7.2\" }",
    Active=toggle,
    Component="{ .Push")  # -> Objects, Success
