# Grasshopper definition Cheat-Sheet-BHoM-Geo.gh (Grasshopper 1.0.7)
# plug-ins: BH.UI.Grasshopper

# ---- group: Node + Constraint
fixconstraint6dof = FixConstraint6DOF(Name="Fix", Component="{ .FixConstraint6DOF")
pt = ConstructPoint(XCoordinate="0", YCoordinate="10", ZCoordinate="0")
pinconstraint6dof = PinConstraint6DOF(Name="Pin", Component="{ .PinConstraint6DOF")
pt_2 = ConstructPoint(XCoordinate="0", YCoordinate="20", ZCoordinate="0")
pt_3 = ConstructPoint(XCoordinate="0", YCoordinate="30", ZCoordinate="0")
constraint6dof = Constraint6DOF(
    X=Toggle(False),
    Y=Toggle(False),
    Z=Toggle(False),
    Xx=Toggle(False),
    Yy=Toggle(False),
    Zz=Toggle(False),
    Component="{ .Constraint6DOF")
node = Node(Coordinates=pt, Support=pinconstraint6dof, Component="{ .Node")
node_2 = Node(Coordinates=pt_2, Support=fixconstraint6dof, Component="{ .Node")
node_3 = Node(Coordinates=pt_3, Support=constraint6dof, Component="{ .Node")

# ---- group: Node
# BHoM Cheat Sheet
# LEGEND
# Node
# Node
# Bars
# Node
# Panels
# - Nodes Contain of geometrical information
# (GH component) and potentially constraints and a name.
# 
# - Create by Typing: "Shift+Ctr+B" and search for "Structure Node"
# 
# - Find some Examples below
# Push/Pull
panel = Panel("0")
pt_4 = ConstructPoint(XCoordinate=panel, YCoordinate="0", ZCoordinate="0")
node_4 = Node(Coordinates=pt_4, Component="{ .Node")

# ---- group: Timber Bar
# Bars
# Bars
# - Most importatnt inputs are Start/End And SectionProperty.
# 
# - For finding Bars: "Shift+Ctr+B" search for Structure + Bar. Multiple options can be found.
# 
# - Two example have been defined Below.
# 
# - Examples have been divided in Timber,  Concrete and Steel.
bhom = BHoMObject(
    "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",
    ObjectType="{ \"_t\" : \"System.Type\", \"Name\" : \"System.Object, mscorlib, Version=4.0.0.0, Culture=neutral, PublicKeyToken=b77a5c561934e089\", \"_bhomVersion\" : \"7.3\" }",
    m_ForcePreview=False,
    m_MaxItemsPreview=10000)
bhom_2 = BHoMObject(
    "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",
    ObjectType="{ \"_t\" : \"System.Type\", \"Name\" : \"System.Object, mscorlib, Version=4.0.0.0, Culture=neutral, PublicKeyToken=b77a5c561934e089\", \"_bhomVersion\" : \"7.3\" }",
    m_ForcePreview=False,
    m_MaxItemsPreview=10000)
sawntimber = SawnTimber(
    {"C14": 0, "C16": 1, "C18": 2, "C20": 3, "C22": 4, "C24": 5, "C27": 6, "C30": 7, "C35": 8, "C40": 9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}, selected="C14",
    Component="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",
    Selection=0)
circleprofile = CircleProfile(Diameter=Slider(0.6, range=0..1), Component="{ .CircleProfile")
circleprofile_2 = CircleProfile(Diameter=Slider(0.8, range=0..1), Component="{ .CircleProfile")
glulam = Glulam(
    {"GL 20c": 0, "GL 22c": 1, "GL 24c": 2, "GL 26c": 3, "GL 28c": 4, "GL 30c": 5, "GL 32c": 6, "GL 20h": 7, "GL 22h": 8, "GL 24h": 9, "GL 26h": 10, "GL 28h": 11, "GL 30h": 12, "GL 32h": 13}, selected="GL 20c",
    Component="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",
    Selection=0)
genericsectionfromprofile = GenericSectionFromProfile(Profile=circleprofile, Material=sawntimber, Component="{ .GenericSectionFromProfile")
genericsectionfromprofile_2 = GenericSectionFromProfile(Profile=circleprofile_2, Material=glulam, Component="{ .GenericSectionFromProfile")
merge = Merge(Data1=genericsectionfromprofile, Data2=genericsectionfromprofile_2)
item = ListItem(List=flatten(merge), Index=Slider(0, range=0..1), Wrap=True)
bar = Bar(
    Start=bhom,
    End=bhom_2,
    SectionProperty=item,
    OrientationAngle=0,
    FEAType="{ \"_t\" : \"System.Enum\", \"TypeName\" : { \"_t\" : \"System.Type\", \"Name\" : \"BH.oM.Structure.Elements.BarFEAType\", \"_bhomVersion\" : \"7.3\" }, \"Value\" : \"Flexural\", \"_bhomVersion\" : \"7.3\" }",
    Component="BH.oM.Structure.Elements.Bar")

# ---- group: Concrete Bar
concrete = Concrete(
    {"C12/15": 0, "C16/20": 1, "C20/25": 2, "C25/30": 3, "C30/37": 4, "C35/45": 5, "C40/50": 6, "C45/55": 7, "C50/60": 8, "C55/67": 9, "C60/75": 10, "C70/85": 11, "C80/95": 12, "C90/105": 13}, selected="C55/67",
    Component="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",
    Selection=9)
concrete_2 = Concrete(
    {"C12/15": 0, "C16/20": 1, "C20/25": 2, "C25/30": 3, "C30/37": 4, "C35/45": 5, "C40/50": 6, "C45/55": 7, "C50/60": 8, "C55/67": 9, "C60/75": 10, "C70/85": 11, "C80/95": 12, "C90/105": 13}, selected="C12/15",
    Component="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",
    Selection=0)
pt_5 = Point(Point(0, 10, 0))
pt_6 = Point(Point(0, 20, 0))
ln = Line(StartPoint=pt_5, EndPoint=pt_6)
concreterectanglesection = ConcreteRectangleSection(Height=Slider(1, range=0..1), Width=Slider(1, range=0..1), Material=concrete, Component="{ .ConcreteRectangleSection")
concretecircularsection = ConcreteCircularSection(Diameter=Slider(1, range=0..1), Material=concrete_2, Component="{ .ConcreteCircularSection")
merge_2 = Merge(Data1=concreterectanglesection, Data2=concretecircularsection)
item_2 = ListItem(List=merge_2, Index=Slider(1, range=0..1), Wrap=True)
bar_2 = Bar(
    Line=ln,
    SectionProperty=item_2,
    OrientationAngle=0,
    FeaType="{ \"_t\" : \"System.Enum\", \"TypeName\" : { \"_t\" : \"System.Type\", \"Name\" : \"BH.oM.Structure.Elements.BarFEAType\", \"_bhomVersion\" : \"7.3\" }, \"Value\" : \"Flexural\", \"_bhomVersion\" : \"7.3\" }",
    Component="{ .Bar")

# ---- group: Steel Bar
pt_7 = Point(Point(0, 20, 0))
pt_8 = Point(Point(0, 40, 0))
ipe = IPE(
    {"IPE 600": 0, "IPE 550": 1, "IPE 500": 2, "IPE 450": 3, "IPE 400": 4, "IPE 360": 5, "IPE 330": 6, "IPE 300": 7, "IPE 270": 8, "IPE 240": 9, "IPE 220": 10, "IPE 200": 11, "IPE 180": 12, "IPE 160": 13, "IPE 140": 14, "IPE 120": 15, "IPE 100": 16, "IPE 80": 17}, selected="IPE 600",
    Component="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",
    Selection=0)
he = HE(
    {"HE 1000 M": 0, "HE 1000 B": 1, "HE 1000 A": 2, "HE 900 M": 3, "HE 900 B": 4, "HE 900 A": 5, "HE 800 M": 6, "HE 800 B": 7, "HE 800 A": 8, "HE 700 M": 9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}, selected="HE 1000 M",
    Component="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",
    Selection=0)
ln_2 = Line(StartPoint=pt_7, EndPoint=pt_8)
item_3 = ListItem(List=[ipe, he], Index=Slider(0, range=0..1), Wrap=True)
bar_3 = Bar(
    Line=ln_2,
    SectionProperty=item_3,
    OrientationAngle=0,
    FeaType="{ \"_t\" : \"System.Enum\", \"TypeName\" : { \"_t\" : \"System.Type\", \"Name\" : \"BH.oM.Structure.Elements.BarFEAType\", \"_bhomVersion\" : \"7.3\" }, \"Value\" : \"Flexural\", \"_bhomVersion\" : \"7.3\" }",
    Component="{ .Bar")

# ---- group: Multiple Steel Bars Bar
crv = Curve([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])
display_list_of_bars = Panel(crv)
ipe_2 = IPE(
    {"IPE 600": 0, "IPE 550": 1, "IPE 500": 2, "IPE 450": 3, "IPE 400": 4, "IPE 360": 5, "IPE 330": 6, "IPE 300": 7, "IPE 270": 8, "IPE 240": 9, "IPE 220": 10, "IPE 200": 11, "IPE 180": 12, "IPE 160": 13, "IPE 140": 14, "IPE 120": 15, "IPE 100": 16, "IPE 80": 17}, selected="IPE 500",
    Component="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",
    Selection=2)
bar_4 = Bar(
    Line=crv,
    SectionProperty=ipe_2,
    OrientationAngle=0,
    FeaType="{ \"_t\" : \"System.Enum\", \"TypeName\" : { \"_t\" : \"System.Type\", \"Name\" : \"BH.oM.Structure.Elements.BarFEAType\", \"_bhomVersion\" : \"7.3\" }, \"Value\" : \"Flexural\", \"_bhomVersion\" : \"7.3\" }",
    Component="{ .Bar")

# ----
extrude = Extrude(Bar=bar_2, Simple=False, Component="{ .Extrude")
extrude_2 = Extrude(Bar=bar_3, Simple=False, Component="{ .Extrude")
extrude_3 = Extrude(Bar=bar_4, Simple=False, Component="{ .Extrude")
extrude_4 = Extrude(Bar=bar, Simple=False, Component="{ .Extrude")

# ----
# Normal surface
number_slider = Slider(0.3, range=0..1)
concrete_3 = Concrete(
    {"C12/15": 0, "C16/20": 1, "C20/25": 2, "C25/30": 3, "C30/37": 4, "C35/45": 5, "C40/50": 6, "C45/55": 7, "C50/60": 8, "C55/67": 9, "C60/75": 10, "C70/85": 11, "C80/95": 12, "C90/105": 13}, selected="C50/60",
    Component="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",
    Selection=8)
# Panels
crv_2 = Curve(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)
crv_3 = Curve([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])
constantthickness = ConstantThickness(
    Thickness=number_slider,
    Material=concrete_3,
    PanelType="{ \"_t\" : \"System.Enum\", \"TypeName\" : { \"_t\" : \"System.Type\", \"Name\" : \"BH.oM.Structure.SurfaceProperties.PanelType\", \"_bhomVersion\" : \"7.3\" }, \"Value\" : \"Slab\", \"_bhomVersion\" : \"7.3\" }",
    Component="BH.oM.Structure.SurfaceProperties.ConstantThickness")
panel_2 = Panel(Outline=crv_2, Openings=crv_3, Property=constantthickness, Tolerance=1e-06, Component="{ .Panel")

# ----
# Multiple Surface with Openings
concrete_4 = Concrete(
    {"C12/15": 0, "C16/20": 1, "C20/25": 2, "C25/30": 3, "C30/37": 4, "C35/45": 5, "C40/50": 6, "C45/55": 7, "C50/60": 8, "C55/67": 9, "C60/75": 10, "C70/85": 11, "C80/95": 12, "C90/105": 13}, selected="C12/15",
    Component="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",
    Selection=0)
crv_4 = Curve([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])
display_list_of_bars_2 = Panel(crv_4)
constantthickness_2 = ConstantThickness(
    Thickness=Slider(0.4, range=0..1),
    Material=concrete_4,
    PanelType="{ \"_t\" : \"System.Enum\", \"TypeName\" : { \"_t\" : \"System.Type\", \"Name\" : \"BH.oM.Structure.SurfaceProperties.PanelType\", \"_bhomVersion\" : \"7.3\" }, \"Value\" : \"Slab\", \"_bhomVersion\" : \"7.3\" }",
    Component="BH.oM.Structure.SurfaceProperties.ConstantThickness")
panel_3 = Panel(Outline=crv_4, Property=constantthickness_2, Tolerance=1e-06, Component="{ .Panel")

# ---- group: Push
toggle = BooleanToggle(False)
# Push/Pull
# Pull
# The Pull components input requires a FileterByBHoMType component.
# The FilterByBHoMType component does again require a BHoMType as input.
# For searching a corresponding BHoM type please type "Ctr + Shift + B" and look for "Structure 'Typename' "
bhom_3 = BHoMObject(
    [bar, bar_2, panel_2, panel_3, bar_3, bar_4],
    ObjectType="{ \"_t\" : \"System.Type\", \"Name\" : \"System.Object, mscorlib, Version=4.0.0.0, Culture=neutral, PublicKeyToken=b77a5c561934e089\", \"_bhomVersion\" : \"7.3\" }",
    m_ForcePreview=False,
    m_MaxItemsPreview=10000)
rfem6adapter = RFEM6Adapter(Active=toggle, Component="{ ..ctor")
push = Push(
    Adapter=rfem6adapter,
    Objects=flatten(bhom_3),
    PushType="{ \"_t\" : \"System.Enum\", \"TypeName\" : { \"_t\" : \"System.Type\", \"Name\" : \"BH.oM.Adapter.PushType\", \"_bhomVersion\" : \"7.3\" }, \"Value\" : \"AdapterDefault\", \"_bhomVersion\" : \"7.3\" }",
    Active=toggle,
    Component="{ .Push")  # -> Objects, Success

# ---- group: Pull
toggle_2 = BooleanToggle(False)
createtype = CreateType(Component="BH.oM.Structure.Elements.Bar")
filterbybhomtype = FilterByBHoMType(BHoMType=createtype, Component="{ .FilterByBHoMType")
rfem6adapter_2 = RFEM6Adapter(Active=toggle_2, Component="{ ..ctor")
pull = Pull(
    Adapter=rfem6adapter_2,
    Request=filterbybhomtype,
    PullType="{ \"_t\" : \"System.Enum\", \"TypeName\" : { \"_t\" : \"System.Type\", \"Name\" : \"BH.oM.Adapter.PullType\", \"_bhomVersion\" : \"7.3\" }, \"Value\" : \"AdapterDefault\", \"_bhomVersion\" : \"7.3\" }",
    Active=toggle_2,
    Component="{ .Pull")
