# Grasshopper definition RFEM6_Toolkit_Hack_Session_Stage1.gh (Grasshopper 1.0.7)
# plug-ins: BH.UI.Grasshopper

getinfo = GetInfo(Component="{ .GetInfo")

# ----
# Plugin Libraries Used: BH.UI.Grasshopper | ver: 7.0.0.0
project_name = Panel("...")
project_number = Panel("...")
author = Panel("HvL")
units = Panel("standard - SI")
associated_rhino_file = Panel("none")
bhom_version_used_to_create = Panel("7.1")
bhom_version_currently_installed = Panel(getinfo)
setprojectid = SetProjectID(ProjectID=project_number, Component="{ .SetProjectID")
c_script = CSharpScript(x=Button())  # inputs x: Boolean
# ---------- c_script: C# usings ----------
using System.IO;
using System.Linq;
using System.Data;
using System.Drawing;
using System.Reflection;
using System.Text.RegularExpressions;
using System.Windows.Forms;
using System.Xml;
using System.Xml.Linq;
using System.Runtime.InteropServices;

using Rhino.DocObjects;
using Rhino.Collections;
using GH_IO;
using GH_IO.Serialization;
# ---------- c_script: C# ----------
    if (x)
    {
      check_canvas();
    }
    else
    {
      var msg = "Plug in a button and I will run when pressed! Don't use a boolean toggle, I work best with just a button";
      this.Component.AddRuntimeMessage(Grasshopper.Kernel.GH_RuntimeMessageLevel.Remark, msg);
    }
# ---------- c_script: C# additional code ----------
  public void check_canvas()
  {
    // method to check if there is already a panel with the correct NickName
    bool PluginPanel = false;
    var ghdoc = Component.OnPingDocument();
    string name = "Plugin Libraries Used";
    try {
      Grasshopper.Kernel.Special.GH_Panel panel = ghdoc.Objects.OfType<Grasshopper.Kernel.Special.GH_Panel>().First(p => p.NickName == name);
      if (panel.NickName == name) {
        panel.UserText = this.libraries();
        panel.ExpireSolution(true);
        PluginPanel = true;
      }
    }
    catch {
      this.Component.AddRuntimeMessage(Grasshopper.Kernel.GH_RuntimeMessageLevel.Remark, "sys.exc_info()[1].ToString() error");
    } // no idea if this runtime warning works

    // this makes a new panel and fills it, if there was no panel to begin with
    if (!(PluginPanel)) {
      var newpanel = new Grasshopper.Kernel.Special.GH_Panel();
      newpanel.CreateAttributes();
      newpanel.NickName = name;
      newpanel.UserText = this.libraries();
      newpanel.Properties.Font = new System.Drawing.Font("Segoe UI", 8);
      newpanel.Properties.Colour = System.Drawing.Color.FromArgb(227, 224, 214); //grey colour
      newpanel.Properties.Multiline = false;
      newpanel.Attributes.Pivot = new System.Drawing.PointF(-310, 910);
      newpanel.Attributes.Bounds = new System.Drawing.RectangleF(0, 0, 290, 250);
      ghdoc.AddObject(newpanel, false);
    }
  }


  public string libraries()
  {
    // this method creates a list of the plugins used that are not the part of the core of grasshopper
    var server = Grasshopper.Instances.ComponentServer;
    var Plugs = new System.Text.StringBuilder();
    Dictionary<object, string> objids = new Dictionary<object, string>();
    Dictionary<object, string> addonLibs = new Dictionary<object, string>();
    try {
      foreach (var obj in Component.OnPingDocument().Objects) {
        // gathers object information
        var objId = obj.ComponentGuid;
        // checks if objectID is already in the objectIDs list
        if (objids.ContainsKey(objId)) {
          continue;
        }
        objids.Add(objId, "");

        // gets the assembly (plugin library) of the object
        var lib = server.FindAssemblyByObject(obj);
        if (lib == null) {
          continue;
        }
        // checks if the assembly is already in the plugin list
        if (addonLibs.ContainsKey(lib.Id)) {
          continue;
        }
        // checks if the assembly is a core assembly
        if (lib.IsCoreLibrary) {
          continue;
        }
          // checks if there is a name to display
          // python component is not regonised as a core assembly
          //        if (lib.Name == "") {
          //          continue;
          //        }
          // adds the assembly to the plugin list and makes the string
        else {
          addonLibs.Add(lib.Id, "");
          // remove empty last line
          if (addonLibs.Count > 1) {
            Plugs.Append("\n");
          }
          // add name and version of plugin
          if (lib.Name != null) {
            Plugs.Append(lib.Name + " | ver: " + lib.Version);
          }
        }
      }
    }
    catch {
      this.Component.AddRuntimeMessage(Grasshopper.Kernel.GH_RuntimeMessageLevel.Remark, "sys.exc_info()[1].ToString() error");
    }
    return  Plugs.ToString();
  }
# ---------- end c_script ----------
date = Panel("19-01-2024")
date_2 = Panel("xx-xx-xxxx")
script_description = Panel("Description ...")
# RFEM6_Toolkit_Hack_Session_Stage1
# LEGEND
# Input
revision = Panel("P03")
# Base + Top Circle
# Bar Line + Panel + Opening Definition
signed = Panel("")

# ---- group: Parameters 1 - Geometry
# Input
shifts = Slider(3, range=0..10)
supports = Slider(9, range=2..20)
height = Slider(50, range=0..100)
base_radius = Slider(10, range=0..10)
top_radius = Slider(10, range=0..10)
panel_position = Slider(50, range=0..50)

# ---- group: Parameters 2 - BHoM
concrete = Concrete(
    {"C12/15": 0, "C16/20": 1, "C20/25": 2, "C25/30": 3, "C30/37": 4, "C35/45": 5, "C40/50": 6, "C45/55": 7, "C50/60": 8, "C55/67": 9, "C60/75": 10, "C70/85": 11, "C80/95": 12, "C90/105": 13}, selected="C12/15",
    Component="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",
    Selection=0)
concrete_2 = Concrete(
    {"C12/15": 0, "C16/20": 1, "C20/25": 2, "C25/30": 3, "C30/37": 4, "C35/45": 5, "C40/50": 6, "C45/55": 7, "C50/60": 8, "C55/67": 9, "C60/75": 10, "C70/85": 11, "C80/95": 12, "C90/105": 13}, selected="C12/15",
    Component="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",
    Selection=0)
concrete_3 = Concrete(
    {"C12/15": 0, "C16/20": 1, "C20/25": 2, "C25/30": 3, "C30/37": 4, "C35/45": 5, "C40/50": 6, "C45/55": 7, "C50/60": 8, "C55/67": 9, "C60/75": 10, "C70/85": 11, "C80/95": 12, "C90/105": 13}, selected="C12/15",
    Component="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",
    Selection=0)
diameter_inclined_bars = Slider(0.7, range=0..1)
section_diameter_top_ring = Slider(0.6, range=0..1)
panel_thickness = Slider(0.5, range=0..1)

# ----
# Base + Top Circle
num = Number(supports)
num_2 = Number(base_radius)
num_3 = Number(height)
num_4 = Number(top_radius)

# ---- group: Base Circle + Split
pt = ConstructPoint(XCoordinate=0, YCoordinate=0, ZCoordinate=0)
cir = Circle(Plane=pt, Radius=num_2)
divide = DivideCurve(Curve=cir, Count=num, Kinks=False)  # -> Points, Tangents, Parameters

# ---- group: Top Circle + Split
pt_2 = ConstructPoint(XCoordinate=0, YCoordinate=0, ZCoordinate=num_3)
cir_2 = Circle(Plane=pt_2, Radius=num_4)
divide_2 = DivideCurve(Curve=cir_2, Count=num, Kinks=False)  # -> Points, Tangents, Parameters

# ----
geo = Geometry(divide.Points)
geo_2 = Geometry(divide_2.Points)

# ----
# Bar Line + Panel + Opening Definition
geo_3 = Geometry(geo)
geo_4 = Geometry(geo_2)

num_5 = Number(shifts)
num_6 = Number(panel_position)

num_7 = Number(num_5)
geo_5 = Geometry(geo_4)
neg = Negative(Value=num_5)
geo_6 = Geometry(geo_4)
shift = ShiftList(List=geo_6, Shift=num_7, Wrap=True)
shift_2 = ShiftList(List=geo_5, Shift=neg, Wrap=True)
geo_7 = Geometry(geo_3)
geo_8 = Geometry(geo)
ln = Line(StartPoint=geo_7, EndPoint=shift)
ln_2 = Line(StartPoint=geo_8, EndPoint=shift_2)
crv = Curve(ln)
crv_2 = Curve(ln_2)

pline = PolyLine(Vertices=geo_4, Closed=Toggle(True))
explode = Explode(Curve=pline, Recursive=True)  # -> Segments, Vertices
crv_3 = Curve(explode.Segments)

merge = Merge(Data1=crv_2, Data2=crv, Data3=crv_3)
bbox = BoundingBox(Content=merge, Plane=PlaneXY(0, 0, 0), UnionBox=True)  # -> Box, Box_2
debox = DeconstructBox(Box=bbox.Box)  # -> Plane, X, Y, Z
rectangle = Rectangle(Plane=debox.Plane, XSize=debox.X, YSize=debox.Y, Radius=0)  # -> Rectangle, Length
num_8 = Number(num_6)
Z = UnitZ(Factor=num_8)
srf = Surface(rectangle.Rectangle)
move = Move(Geometry=srf, Motion=Z)  # -> Geometry, Transform
blx = BrepLine(Brep=move.Geometry, Line=[crv_2, crv], LimitToFirst=False)  # -> Curves, flatten(Points)
cset = CreateSet(List=blx.Points)  # -> Set, Map
alongcrv = SortAlongCurve(Points=cset.Set, Curve=srf)  # -> Points, Indices
pline_2 = PolyLine(Vertices=alongcrv.Points, Closed=Toggle(True))
crv_4 = Curve(pline_2)

crv_5 = Curve(pline_2)
bbox_2 = BoundingBox(Content=crv_5, Plane=PlaneXY(0, 0, 0))  # -> Box, Box_2
area = Area(Geometry=crv_5)  # -> Area, Centroid
debox_2 = DeconstructBox(Box=bbox_2.Box)  # -> Plane, X, Y, Z
num_9 = Number(debox_2.X)
division = Division(A=num_9, B="2")
cir_3 = Circle(Plane=area.Centroid, Radius=division)
scale = Scale(Geometry=cir_3, Center=area.Centroid, Factor=0.5)  # -> Geometry, Transform
geo_9 = Geometry(scale.Geometry)

geo_10 = Geometry(geo_3)
pline_3 = PolyLine(Vertices=geo_10, Closed=Toggle(True))

crv_6 = Curve(crv_3)
crv_7 = Curve(crv_2)
geo_11 = Geometry(crv_4)
crv_8 = Curve(crv)
geo_12 = Geometry(geo_9)
geo_13 = Geometry(pline_3)

# ---- group: Inclied Bars 1
crv_9 = Curve(crv_7)

# ---- group: Movable Panel
srf_2 = Surface(geo_11)

# ----
inclined_bars_2 = Curve(crv_8)

# ---- group: Top Bars
crv_10 = Curve(crv_6)

# ---- group: Opening
curve = Curve(geo_12)

# ---- group: Bottom Panel
srf_3 = Surface(geo_13)
